# Grasshopper definition parametric tower 1.gh (Grasshopper 1.0.8)

# ----
# Parameters/Controls
total_rotation = Slider(360, range=0..360)
number_of_floors = Slider(25, range=0..100)
floor_height = Slider(2500, range=0..10000)
radius_1 = Slider(5000, range=3000..30000)
radius_2 = Slider(4000, range=3000..30000)
t = Slider(2, range=0..10)

# ----
# Make a point in the 'Default' layer to start!
# Start
geometry_pipeline = GeometryPipeline(
    GroupByLayer=False,
    GroupByType=False,
    IncludeHidden=True,
    IncludeLocked=True,
    LayerFilter="Default",
    NameFilter="*",
    SublayerFiltering=True,
    TypeFilter=1)

# ----
# Reference Point & Axis
point = Point(graft(geometry_pipeline))
move_up = MoveUp(geometry=point)
panel = Panel(move_up)
line = Line(StartPoint=point, EndPoint=move_up)
panel_2 = Panel(line)

# ----
# Move Points to Floor Levels
panel_3 = Panel("0")
series = Series(Start=panel_3, Step=floor_height, Count=number_of_floors)
unit_z = UnitZ(Factor=series)
move = Move(Geometry=point, Motion=unit_z)  # -> Geometry, Transform

# ----
# Ellipse Radii vary along a Sine Curve
multiplication = Multiplication(A=floor_height, B=number_of_floors)
ellipse_radii = EllipseRadii(x=series, A=radius_1, t=t, H=multiplication)
ellipse_radii_2 = EllipseRadii(x=series, A=radius_2, t=t, H=multiplication)

# ----
# Make Ellipses and Rotate them
division = Division(A=total_rotation, B=number_of_floors)
ellipse = Ellipse(Plane=move.Geometry, Radius1=ellipse_radii, Radius2=ellipse_radii_2)  # -> Ellipse, Focus1, Focus2
panel_4 = Panel(ellipse.Ellipse)
series_2 = Series(Start="0", Step=division, Count=number_of_floors)
rotate_axis = RotateAxis(Geometry=ellipse.Ellipse, Angle=degrees(series_2), Axis=line)  # -> Geometry, Transform
panel_5 = Panel(series_2)
panel_6 = Panel(rotate_axis.Geometry)

# ----
# Extrude and make Solids for each Floor
unit_z_2 = UnitZ(Factor=floor_height)
extrude = Extrude(Base=rotate_axis.Geometry, Direction=unit_z_2)
cap_holes = CapHoles(Brep=extrude)
panel_7 = Panel(cap_holes)

# ==== cluster EllipseRadii
x = ClusterInput()
A = ClusterInput()
t = ClusterInput()
H = ClusterInput()
python_3_script = Python3Script(x=x, A=A, t=t, H=H)  # -> out, y; inputs x: list
# ---------- python_3_script: Python ----------
import math

l = len(x)
y = []

for i in range(l):
    h = x[i]
    temp = A*(math.sin(2*(math.pi)*(h/H)*t))
    temp = temp + 3*A
    y.append(temp)


print(y)
# ---------- end python_3_script ----------
y = ClusterOutput(python_3_script.y)

# ==== cluster MoveUp
unit_z = UnitZ(Factor=1)
geometry = ClusterInput()
move = Move(Geometry=geometry, Motion=unit_z)  # -> Geometry, Transform
geometry_2 = ClusterOutput(move.Geometry)
