# Grasshopper definition points-circles.gh (Grasshopper 1.0.8)

geometry_pipeline = GeometryPipeline(
    GroupByLayer=False,
    GroupByType=False,
    IncludeHidden=True,
    IncludeLocked=True,
    LayerFilter="Default",
    NameFilter="*",
    SublayerFiltering=True,
    TypeFilter=1)
count = Slider(5, range=0..100)
grid = Slider(200, range=0..1000)
construct_point = ConstructPoint(XCoordinate=0, YCoordinate=0, ZCoordinate=0)
panel = Panel(geometry_pipeline)
python_3_script = Python3Script(num_pts=count, grid_dist=grid)  # -> out, a
# ---------- python_3_script: Python ----------
num_cols = num_pts - 1

totalL = grid_dist * num_cols

halfL = totalL/2

a = (-1) * halfL
# ---------- end python_3_script ----------
unit_x = UnitX(Factor=python_3_script.a)
unit_y = UnitY(Factor=python_3_script.a)
move = Move(Geometry=construct_point, Motion=unit_x)  # -> Geometry, Transform
move_2 = Move(Geometry=move.Geometry, Motion=unit_y)  # -> Geometry, Transform
series = Series(Start="0", Step=grid, Count=count)
unit_y_2 = UnitY(Factor=series)
move_3 = Move(Geometry=move_2.Geometry, Motion=unit_y_2)  # -> graft(Geometry), Transform
unit_x_2 = UnitX(Factor=series)
move_4 = Move(Geometry=move_3.Geometry, Motion=unit_x_2)  # -> Geometry, Transform
panel_2 = Panel(move_3.Geometry)
point = Point(flatten(move_4.Geometry))
python_3_script_2 = Python3Script(x=point, c=geometry_pipeline, factor=Slider(10, range=0..100))  # -> out, a; inputs x: list of Point3d, c: list of Point3d
# ---------- python_3_script_2: Python ----------
import Rhino.Geometry as rg

a = []

num_pts = len(x)
print('Grid Points: ' + str(num_pts))

num_c = len(c)
print('Control Points: ' + str(num_c))

#for each point in x
for pt in x:

    radius = []
    #for each control point in c
    for cp in c:

        d = cp.DistanceTo(pt)
        r = d/(factor*num_c)
        radius.append(r)
    
    r = 0
    #calculate radius for multiple points
    for i in range(num_c):
        r = r + radius[i]
        print(r)

    #output circles
    a.append(rg.Circle(pt, r))
# ---------- end python_3_script_2 ----------
