# Grasshopper definition box.gh (Grasshopper 1.0.8)
# plug-ins: Triceratops

width = Slider(10, range=0..10)
depth = Slider(2, range=0..10)
height = Slider(10, range=0..10)
construct_point = ConstructPoint(XCoordinate=0, YCoordinate=0, ZCoordinate=0)
width_2 = Number(width)
depth_2 = Number(depth)
height_2 = Number(height)
divide_by_2 = DivideBy2(A=width_2)
divide_by_2_2 = DivideBy2_2(A=width_2)
move_x = MoveX(geometry=construct_point, factor=divide_by_2)
move_x_2 = MoveX(geometry=construct_point, factor=divide_by_2_2)
divide_by_2_3 = DivideBy2(A=depth_2)
divide_by_2_4 = DivideBy2_2(A=depth_2)
move_y = MoveY_2(geometry=move_x, factor=divide_by_2_3)
move_y_2 = MoveY(geometry=move_x_2, factor=divide_by_2_4)
move_z = MoveZ(geometry=move_y, factor=height_2)
xy_plane = XYPlane(Origin=Point(0, 0, 0))
colour_rgb = ColourRGB(Alpha=255, Red=Slider(0, range=0..255), Green=Slider(0, range=0..255), Blue=Slider(255, range=0..255))
point = Point(<point referenced from the Rhino model>)
box_2pt = Box2Pt(PointA=move_y_2, PointB=move_z, Plane=xy_plane)
pointlight = PointLight(Position=point, Color=colour_rgb, Intensity=1, Distance=0, Decay=1, CastShadow=False)  # -> Helper, Light
hempispherelight = HempisphereLight(Color=RGB(135, 206, 250), GroundColor=RGB(210, 180, 140), Intensity=0.5)
geometry = Geometry(box_2pt)
meshstandardmaterial = MeshStandardMaterial(Color=RGB(255, 255, 255), Opacity=1, Roughness=1, Metalness=0.5, Emissive=RGB(0, 0, 0), EmissiveIntensity=1)
out = Geometry(geometry)
mesh_brep = MeshBrep(
    Brep=out,
    Settings={GridMaxCount=0, GridMinCount=16, JaggedSeams=False, MaxEdgeLength=0, MinEdgeLength=0.0001, MinTolerance=0, Refine=True, RefineAngle=0, RelativeTolerance=0.65, SimplePlanes=True, Tolerance=0})
mesh = Mesh(Mesh=mesh_brep, Material=meshstandardmaterial, DecimalAccuracy=3)
merge = Merge(Data1=mesh, Data2=pointlight.Light, Data3=hempispherelight)
compile_scene = CompileScene(Objects=merge)
serializeobject = SerializeObject(Object3d=compile_scene, Minify=False, Run=True)
panel = Panel("C:\Users\Varun SA\Documents\computational-modelling\2-web-interops")
panel_2 = Panel(serializeobject)
write_text_file = WriteTextFile(Path=panel, FileName="triceratops.json", Data=serializeobject, Write=Button())

# ==== cluster DivideBy2
A = ClusterInput()
division = Division(A=A, B="2")
result = ClusterOutput(division)

# ==== cluster DivideBy2_2
A = ClusterInput()
division = Division(A=A, B="-2")
result = ClusterOutput(division)

# ==== cluster MoveX
factor = ClusterInput()
unit_x = UnitX(Factor=factor)
geometry = ClusterInput()
move = Move(Geometry=geometry, Motion=unit_x)  # -> Geometry, Transform
geometry_2 = ClusterOutput(move.Geometry)

# ==== cluster MoveY
geometry = ClusterInput()
factor = ClusterInput()
unit_y = UnitY(Factor=factor)
move = Move(Geometry=geometry, Motion=unit_y)  # -> Geometry, Transform
geometry_2 = ClusterOutput(move.Geometry)

# ==== cluster MoveY_2
factor = ClusterInput()
unit_y = UnitY(Factor=factor)
geometry = ClusterInput()
move = Move(Geometry=geometry, Motion=unit_y)  # -> Geometry, Transform
geometry_2 = ClusterOutput(move.Geometry)

# ==== cluster MoveZ
geometry = ClusterInput()
factor = ClusterInput()
unit_z = UnitZ(Factor=factor)
move = Move(Geometry=geometry, Motion=unit_z)  # -> Geometry, Transform
geometry_2 = ClusterOutput(move.Geometry)
