# Grasshopper definition geojson-rh.gh (Grasshopper 1.0.8)
# plug-ins: Geospatial, Triceratops, Bifocals, LunchBox

# ----
# EPSG:32618: PROJCS["WGS 84 / UTM zone 18N",
#   GEOGCS["WGS 84",
#     DATUM["WGS_1984",
#       SPHEROID["WGS 84",6378137,298.257223563,
#         AUTHORITY["EPSG","7030"]],
#       AUTHORITY["EPSG","6326"]],
#     PRIMEM["Greenwich",0,
#       AUTHORITY["EPSG","8901"]],
#     UNIT["degree",0.0174532925199433,
#       AUTHORITY["EPSG","9122"]],
#     AUTHORITY["EPSG","4326"]],
#   PROJECTION["Transverse_Mercator"],
#   PARAMETER["latitude_of_origin",0],
#   PARAMETER["central_meridian",-75],
#   PARAMETER["scale_factor",0.9996],
#   PARAMETER["false_easting",500000],
#   PARAMETER["false_northing",0],
#   UNIT["metre",1,
#     AUTHORITY["EPSG","9001"]],
#   AUTHORITY["EPSG","32618"]]
panel = Panel("-73.98187458515167")
panel_2 = Panel("40.754674479887605")
_1_epsg_4326 = _1EPSG4326()

file_path = FilePath("C:\Users\Varun SA\Documents\computational-modelling\2-web-interops\hia-ref.geojson")
read_geojson = ReadGeoJSON(File=file_path, Mode=False)  # -> Type, Geometry, Keys, Values
reference_geometry = Geometry(read_geojson.Geometry)
scale = Scale(Geometry=reference_geometry, Center=Point(0, 0, 0), Factor="1")  # -> Geometry, Transform
panel_3 = Panel(scale.Geometry)
discontinuity = Discontinuity(Curve=scale.Geometry, Level=1)  # -> flatten(Points), Parameters

cluster = Cluster()  # -> red, green, blue
merge = Merge(Data1="map", Data2="geojson export polygons", Data3="geojson export polylines", Data4="geojson export points")
merge_2 = Merge(Data1=cluster.red, Data2=cluster.green, Data3=cluster.blue)
create_layers = CreateLayers(CreateToggle=Button(), LayerNames=merge, LayerColors=merge_2)

geometry_pipeline = GeometryPipeline(
    GroupByLayer=False,
    GroupByType=False,
    IncludeHidden=True,
    IncludeLocked=True,
    LayerFilter="buildings2",
    NameFilter="*",
    SublayerFiltering=True,
    TypeFilter=4)
panel_4 = Panel(geometry_pipeline)
geometry = Geometry(geometry_pipeline)

south_india_epsg_32643 = Panel("""PROJCS["WGS 84 / UTM zone 43N",
    GEOGCS["WGS 84",
        DATUM["WGS_1984",
            SPHEROID["WGS 84",6378137,298.257223563,
                AUTHORITY["EPSG","7030"]],
            AUTHORITY["EPSG","6326"]],
        PRIMEM["Greenwich",0,
            AUTHORITY["EPSG","8901"]],
        UNIT["degree",0.0174532925199433,
            AUTHORITY["EPSG","9122"]],
        AUTHORITY["EPSG","4326"]],
    PROJECTION["Transverse_Mercator"],
    PARAMETER["latitude_of_origin",0],
    PARAMETER["central_meridian",75],
    PARAMETER["scale_factor",0.9996],
    PARAMETER["false_easting",500000],
    PARAMETER["false_northing",0],
    UNIT["metre",1,
        AUTHORITY["EPSG","9001"]],
    AUTHORITY["EPSG","32643"]]""")
curve = Curve(<curve referenced from the Rhino model>)

geometry_pipeline_2 = GeometryPipeline(
    GroupByLayer=False,
    GroupByType=False,
    IncludeHidden=True,
    IncludeLocked=True,
    LayerFilter="roads",
    NameFilter="*",
    SublayerFiltering=True,
    TypeFilter=4)
panel_5 = Panel(curve)
geometry_2 = Geometry(curve)

_2_transformation = _2Transformation(SourceWKT=_1_epsg_4326, TargetWKT=south_india_epsg_32643)
_4_reprojection = _4Reprojection(SourcePoints=discontinuity.Points, Transformation=_2_transformation)

panel_6 = Panel(discontinuity.Points)

geometry_3 = Geometry(_4_reprojection)
panel_7 = Panel(geometry_3)
polyline = PolyLine(Vertices=geometry_3, Closed=Toggle(True))
polygon_center = PolygonCenter(Polyline=polyline)  # -> CenterV, CenterE, flatten(CenterA)
construct_point = ConstructPoint(XCoordinate=0, YCoordinate=0, ZCoordinate=0)
panel_8 = Panel(polygon_center.CenterA)
vector_2pt = Vector2Pt(PointA=polygon_center.CenterA, PointB=construct_point, Unitize=False)  # -> Vector, Length
move = Move(Geometry=polyline, Motion=vector_2pt.Vector)  # -> flatten(Geometry), Transform
panel_9 = Panel(vector_2pt.Vector)
panel_10 = Panel(move.Geometry)

reverse = Reverse(Vector=vector_2pt.Vector)
move_2 = Move(Geometry=geometry, Motion=reverse)  # -> Geometry, Transform
discontinuity_2 = Discontinuity(Curve=move_2.Geometry, Level=1)  # -> Points, Parameters
panel_11 = Panel(discontinuity_2.Points)

reverse_2 = Reverse(Vector=vector_2pt.Vector)
move_3 = Move(Geometry=geometry_2, Motion=reverse_2)  # -> Geometry, Transform
discontinuity_3 = Discontinuity(Curve=move_3.Geometry, Level=1)  # -> Points, Parameters
panel_12 = Panel(discontinuity_3.Points)

_1_epsg_4326_2 = _1EPSG4326()
_2_transformation_2 = _2Transformation(SourceWKT=south_india_epsg_32643, TargetWKT=_1_epsg_4326_2)
_4_reprojection_2 = _4Reprojection(SourcePoints=discontinuity_2.Points, Transformation=_2_transformation_2)
geometry_4 = Geometry(_4_reprojection_2)
polyline_2 = PolyLine(Vertices=geometry_4, Closed=False)  # -> simplify(Polyline)
geometry_5 = Geometry(flatten(polyline_2))
panel_13 = Panel(polyline_2)
item_index = ItemIndex(List=flatten(geometry_5), Item=flatten(polyline_2))  # -> graft(Index)

panel_14 = Panel(item_index)
ref_geometry = Geometry(move.Geometry)
text = Text(graft("id"))
# Click the Export button to export!
export = Button()

_1_epsg_4326_3 = _1EPSG4326()
_2_transformation_3 = _2Transformation(SourceWKT=south_india_epsg_32643, TargetWKT=_1_epsg_4326_3)
_4_reprojection_3 = _4Reprojection(SourcePoints=discontinuity_3.Points, Transformation=_2_transformation_3)
geometry_6 = Geometry(_4_reprojection_3)
polyline_3 = PolyLine(Vertices=geometry_6, Closed=False)  # -> simplify(Polyline)
geometry_7 = Geometry(flatten(polyline_3))

remove_null_values_py = Python3Script(data=geometry_7)  # -> cleaned; inputs data: list
# ---------- remove_null_values_py: Python ----------
# Method 1: List comprehension
cleaned = [x for x in data if x is not None]

print(cleaned)  # [1, 2, 3, 4, 5]
# ---------- end remove_null_values_py ----------
geometry_8 = Geometry(graft(remove_null_values_py))

panel_15 = Panel(geometry_8)
item_index_2 = ItemIndex(List=flatten(remove_null_values_py), Item=flatten(geometry_8))  # -> graft(Index)

feature_from_polygons = FeatureFromPolygons(Polygons=polyline_2, Keys=text, Values=item_index_2)
feature_from_points = FeatureFromPoints()
feature_from_lines = FeatureFromLines(Curves=geometry_8, Keys=text, Values=item_index_2)
feature_from_polygons_2 = FeatureFromPolygons()

# ---- group: Post-Process GeoJSON
join_geojson = JoinGeoJSON(Features=flatten(feature_from_lines))
crs = Panel("ESPG:4326")
ghpython_script = GhPythonScript(str=join_geojson, crs=crs)  # -> a
# ---------- ghpython_script: Python ----------
__author__ = "rchou"
__version__ = "2022.03.16"

import rhinoscriptsyntax as rs


header = str[:28]
features = str[28:]

if _crs:
    crs = '"crs": { "type": "name", "properties": { "name": "urn:ogc:def:crs:' + _crs + '" } },' 
else:
    crs = '"crs": { "type": "name", "properties": { "name": "urn:ogc:def:crs:EPSG:4326" } },'

a = header + crs + features
# ---------- end ghpython_script ----------

# ---- group: Write GeoJSON
# 5. Export GeoJSON
file_name = Panel("hia-site-boundary.geojson")
overwrite_data = BooleanToggle(True)
relativepath = RelativePath()
write_file = WriteFile(Directory=relativepath, Filename=file_name, Data=ghpython_script, Run=export, Overwrite=overwrite_data)

# ==== cluster Cluster
number_slider = Slider(0, range=0..255)
number_slider_2 = Slider(255, range=0..255)
colour_rgb = ColourRGB(Alpha=255, Red=number_slider, Green=number_slider_2, Blue=number_slider)
colour_rgb_2 = ColourRGB(Alpha=255, Red=number_slider, Green=number_slider, Blue=number_slider_2)
colour_rgb_3 = ColourRGB(Alpha=255, Red=number_slider_2, Green=number_slider, Blue=number_slider)
red = ClusterOutput(colour_rgb_3)
blue = ClusterOutput(colour_rgb_2)
green = ClusterOutput(colour_rgb)
