# Grasshopper definition shapediver_trial.gh (Grasshopper 1.0.8)

floor_height_m = Slider(4, range=0..10)
far = Slider(26, range=0..100)
ground_coverage = Slider(28, range=0..100)
area_sqm = Slider(4189, range=0..10000)
multiplication = Multiplication(A=far, B="100")
square_root = SquareRoot(Value=area_sqm)
multiplication_2 = Multiplication(A=square_root, B="-1/2")
construct_point = ConstructPoint(XCoordinate=multiplication_2, YCoordinate=multiplication_2, ZCoordinate=0)
multiplication_3 = Multiplication(A=ground_coverage, B=area_sqm, C="1/100")
geometry = Geometry([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])
xy_plane = XYPlane(Origin=construct_point)
division = Division(A=multiplication, B=ground_coverage)
square_root_2 = SquareRoot(Value=multiplication_3)
multiplication_4 = Multiplication(A=square_root_2, B="-1/2")
construct_point_2 = ConstructPoint(XCoordinate=multiplication_4, YCoordinate=multiplication_4, ZCoordinate=0)
xy_plane_2 = XYPlane(Origin=construct_point_2)
unit_z = UnitZ(Factor=floor_height_m)
colour_picker = ColourPicker(PickedColour=RGB(133, 255, 210))
plane_surface = PlaneSurface(Plane=xy_plane_2, XSize=square_root_2, YSize=square_root_2)
integer = Integer(division)
panel = Panel(integer)
plane_surface_2 = PlaneSurface(Plane=xy_plane, XSize=square_root, YSize=square_root)
addition = Addition(A="0.3", B=floor_height_m)
extrude = Extrude(Base=plane_surface, Direction=unit_z)
unit_z_2 = UnitZ(Factor="-10")
series = Series(Start="0", Step=addition, Count=integer)
custom_preview = CustomPreview(Geometry=geometry, Material=colour_picker)
extrude_2 = Extrude(Base=plane_surface_2, Direction=unit_z_2)
unit_z_3 = UnitZ(Factor=series)
colour_picker_2 = ColourPicker(PickedColour=RGB(170, 109, 111))
move = Move(Geometry=extrude, Motion=unit_z_3)  # -> Geometry, Transform
colour_picker_3 = ColourPicker(PickedColour=RGB(193, 188, 210))
custom_preview_2 = CustomPreview(Geometry=extrude_2, Material=colour_picker_2)
custom_preview_3 = CustomPreview(Geometry=move.Geometry, Material=colour_picker_3)
