# Grasshopper definition triceratops-shell-cleanroom.gh (Grasshopper 1.0.8)
# plug-ins: Triceratops, Bifocals

mesh = Mesh([<mesh referenced from the Rhino model> x6])
mesh_2 = Mesh([<mesh referenced from the Rhino model> x3])
ground_geometry = Geometry(<mesh referenced from the Rhino model>)
shell_building = Mesh(<mesh referenced from the Rhino model>)
relativepath = RelativePath()
geometry = Geometry([<mesh referenced from the Rhino model> x30])
geometry_2 = Geometry([<mesh referenced from the Rhino model> x11])
shell_building_2 = Mesh([<mesh referenced from the Rhino model> x28])
mesh_join = MeshJoin(Meshes=geometry)
shell_building_3 = Mesh([<mesh referenced from the Rhino model> x2])
mesh_join_2 = MeshJoin(Meshes=ground_geometry)
mesh_join_3 = MeshJoin(Meshes=geometry_2)
mesh_join_4 = MeshJoin(Meshes=mesh)
mesh_join_5 = MeshJoin(Meshes=mesh_2)
mesh_join_6 = MeshJoin(Meshes=shell_building)
mesh_join_7 = MeshJoin(Meshes=shell_building_2)
mesh_join_8 = MeshJoin(Meshes=shell_building_3)

colour_picker = ColourPicker(PickedColour=RGB(168, 84, 94))
meshstandardmaterial = MeshStandardMaterial(Color=colour_picker, Opacity=1, Roughness=1, Metalness=0.5, Emissive=RGB(0, 0, 0), EmissiveIntensity=1)
mesh_3 = Mesh(Mesh=mesh_join_2, Name="ground", Material=meshstandardmaterial, DecimalAccuracy=3)

colour_picker_2 = ColourPicker(PickedColour=RGB(168, 167, 171))
meshstandardmaterial_2 = MeshStandardMaterial(Color=colour_picker_2, Opacity=1, Roughness=1, Metalness=0.5, Emissive=RGB(0, 0, 0), EmissiveIntensity=1)
mesh_4 = Mesh(Mesh=mesh_join, Name="shell foundation", Material=meshstandardmaterial_2, DecimalAccuracy=3)

colour_picker_3 = ColourPicker(PickedColour=RGB(250, 247, 249))
meshstandardmaterial_3 = MeshStandardMaterial(Color=colour_picker_3, Opacity=1, Roughness=1, Metalness=0.5, Emissive=RGB(0, 0, 0), EmissiveIntensity=1)
mesh_5 = Mesh(Mesh=mesh_join_4, Name="cleanroom", Material=meshstandardmaterial_3, DecimalAccuracy=3)

colour_picker_4 = ColourPicker(PickedColour=RGB(217, 212, 209))
meshstandardmaterial_4 = MeshStandardMaterial(Color=colour_picker_4, Opacity=1, Roughness=1, Metalness=0.5, Emissive=RGB(0, 0, 0), EmissiveIntensity=1)
mesh_6 = Mesh(Mesh=mesh_join_5, Name="shell roof", Material=meshstandardmaterial_4, DecimalAccuracy=3)

colour_picker_5 = ColourPicker(PickedColour=RGB(175, 164, 163))
meshstandardmaterial_5 = MeshStandardMaterial(Color=colour_picker_5, Opacity=1, Roughness=1, Metalness=0.5, Emissive=RGB(0, 0, 0), EmissiveIntensity=1)
mesh_7 = Mesh(Mesh=mesh_join_3, Name="roof structure", Material=meshstandardmaterial_5, DecimalAccuracy=3)

colour_picker_6 = ColourPicker(PickedColour=RGB(188, 177, 189))
meshstandardmaterial_6 = MeshStandardMaterial(Color=colour_picker_6, Opacity=1, Roughness=1, Metalness=0.5, Emissive=RGB(0, 0, 0), EmissiveIntensity=1)
mesh_8 = Mesh(Mesh=mesh_join_6, Name="shell building", Material=meshstandardmaterial_6, DecimalAccuracy=3)

colour_picker_7 = ColourPicker(PickedColour=RGB(178, 164, 189))
meshstandardmaterial_7 = MeshStandardMaterial(Color=colour_picker_7, Opacity=1, Roughness=1, Metalness=0.5, Emissive=RGB(0, 0, 0), EmissiveIntensity=1)
mesh_9 = Mesh(Mesh=mesh_join_7, Name="cleanroom foundation", Material=meshstandardmaterial_7, DecimalAccuracy=3)

colour_picker_8 = ColourPicker(PickedColour=RGB(166, 120, 65))
meshstandardmaterial_8 = MeshStandardMaterial(Color=colour_picker_8, Opacity=1, Roughness=1, Metalness=0.5, Emissive=RGB(0, 0, 0), EmissiveIntensity=1)
mesh_10 = Mesh(Mesh=mesh_join_8, Name="trench", Material=meshstandardmaterial_8, DecimalAccuracy=3)

merge = Merge(Data1=mesh_3, Data2=mesh_4, Data3=mesh_7, Data4=mesh_6, Data5=mesh_5, Data6=mesh_8, Data7=mesh_9, Data8=mesh_10)
compile_scene = CompileScene(Objects=merge)
panel = Panel(merge)
serializeobject = SerializeObject(Object3d=compile_scene, Minify=False, Run=Toggle(True))
relativepath_2 = RelativePath()
write_text_file = WriteTextFile(Path=relativepath_2, FileName="triceratops.json", Data=serializeobject, Write=Button())
