# Grasshopper definition butterfly_trial1.gh (Grasshopper 1.0.8)
# plug-ins: LadybugGrasshopper

brep = Brep([<brep referenced from the Rhino model> x5])
createbfgeometry = Butterfly_CreateButterflyGeometry(name="Geo", geo=flatten(brep))  # -> out, BF_geo; plug-in component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
windvector = Butterfly_WindVector(wind_speed="10", wind_direction=Point(0, 1, 0))  # -> wind_vector; plug-in component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
lb_falsestart_toggle = LBFalseStartToggle(True)
panel = Panel(createbfgeometry.BF_geo)
createcasefromtunnel = Butterfly_CreateCaseFromTunnel(
    name="Windtunnel_WIP",
    BF_geo=flatten(createbfgeometry.BF_geo),
    wind_vector=windvector,
    ref_wind_height=10,
    landscape=6,
    run=lb_falsestart_toggle)  # -> out, block_pts, wind_tunnel, case; plug-in component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
lb_falsestart_toggle_2 = LBFalseStartToggle(True)
lb_falsestart_toggle_3 = LBFalseStartToggle(True)
multigrading = Butterfly_MultiGrading(segment_gradings=flatten("100"))  # -> grading; plug-in component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
lb_falsestart_toggle_4 = LBFalseStartToggle(True)
gradxyz = Butterfly_GradingXYZ(x_grading="100", y_grading="100", z_grading="100")  # -> grad_xyz; plug-in component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
blockmesh = Butterfly_blockMesh(
    case=createcasefromtunnel.case,
    grad_xyz=gradxyz,
    overwrite=True,
    write=lb_falsestart_toggle_2,
    run=lb_falsestart_toggle_3)  # -> out, case; plug-in component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
panel_2 = Panel(blockmesh.out)
loadmesh = Butterfly_LoadMesh(case=blockmesh.case, inner_mesh=False, load=lb_falsestart_toggle_4)  # -> mesh; plug-in component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
