# Grasshopper definition ladybug-tutorial1.gh (Grasshopper 1.0.8)

construct_point = ConstructPoint(XCoordinate="0", YCoordinate="0", ZCoordinate="0")
panel = Panel("https://energyplus-weather.s3.amazonaws.com/north_and_central_america_wmo_region_4/USA/NY/USA_NY_New.York.City-Central.Park.744860_TMY2/USA_NY_New.York.City-Central.Park.744860_TMY2.zip")
geometry_pipeline = GeometryPipeline(
    GroupByLayer=False,
    GroupByType=False,
    IncludeHidden=True,
    IncludeLocked=True,
    LayerFilter="FootPrint Surface",
    NameFilter="*",
    SublayerFiltering=True,
    TypeFilter=1073741848)
geometry_pipeline_2 = GeometryPipeline(
    GroupByLayer=False,
    GroupByType=False,
    IncludeHidden=True,
    IncludeLocked=True,
    LayerFilter="RoofTop Surface",
    NameFilter="*",
    SublayerFiltering=True,
    TypeFilter=1073741848)
geometry_pipeline_3 = GeometryPipeline(
    GroupByLayer=False,
    GroupByType=False,
    IncludeHidden=True,
    IncludeLocked=True,
    LayerFilter="Facade Surface",
    NameFilter="*",
    SublayerFiltering=True,
    TypeFilter=1073741848)
downloadepw = LBDownloadWeather(weather_URL=panel)  # -> epw_file, stat_file, ddy_file; plug-in component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
hoy = LBCalculateHOY(month=Slider(12, range=1..12), day=Slider(31, range=1..31), hour=Slider(10, range=0..23), minute=Slider(23, range=0..60))  # -> flatten(hoy), flatten(doy), flatten(date); plug-in component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
geometry_pipeline_4 = GeometryPipeline(
    GroupByLayer=False,
    GroupByType=False,
    IncludeHidden=True,
    IncludeLocked=True,
    LayerFilter="Layer0",
    NameFilter="*",
    SublayerFiltering=True,
    TypeFilter=32)
importloc = LBImportLocation(epw_file=downloadepw.epw_file)  # -> location; plug-in component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
sunpath = LBSunPath(location=importloc, hoys=hoy.hoy, center_pt=construct_point, scale=Slider(32, range=0..100))  # -> out, vectors, altitudes, azimuths, hoys, sun_pts, analemma, daily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; plug-in component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
geometry = Geometry(<extrusion referenced from the Rhino model>)
directsunhours = LBDirectSunHours(vectors=flatten(sunpath.vectors), geometry=flatten(geometry_pipeline_4), context=flatten(geometry_pipeline_3))  # -> out, points, results, mesh, legend, title, int_mtx; plug-in component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
