# Grasshopper definition subdivide_brep.gh (Grasshopper 1.0.8)

geometry_pipeline = GeometryPipeline(
    GroupByLayer=False,
    GroupByType=False,
    IncludeHidden=True,
    IncludeLocked=True,
    LayerFilter="Default",
    NameFilter="*",
    SublayerFiltering=True,
    TypeFilter=1073741848)
cluster = Cluster(brep=geometry_pipeline, B=Slider(21, range=0..100), grid_size_u="1000", grid_size_v="1000")  # -> surface_2, result
panel = Panel(cluster.result)
analysis_surface = Surface(cluster.surface_2)

# ==== cluster Cluster
B = ClusterInput()
grid_size_v = ClusterInput()
grid_size_u = ClusterInput()
brep = ClusterInput()
deconstruct_brep = DeconstructBrep(Brep=brep)  # -> Faces, Edges, Vertices
surface = Surface(graft(deconstruct_brep.Faces))
panel = Panel(surface)
dimensions = Dimensions(Surface=surface)  # -> UDimension, VDimension
division = Division(A=dimensions.UDimension, B=B)
result = ClusterOutput(division)
panel_2 = Panel(dimensions.UDimension)
division_2 = Division(A=dimensions.UDimension, Grid_size_u=grid_size_u)
division_3 = Division(A=dimensions.VDimension, Grid_size_v=grid_size_v)
divide_domain² = DivideDomain²(Domain=surface, UCount=division_2, VCount=division_3)
isotrim = Isotrim(Surface=surface, Domain=divide_domain²)
surface_2 = ClusterOutput(isotrim)
