# Grasshopper definition sunhours_tutorial.gh (Grasshopper 1.0.8)
# plug-ins: Bifocals, LunchBox

start_month = Slider(11, range=1..12)
end_month = Slider(12, range=1..12)

start_day = Slider(25, range=1..31)
end_day = Slider(25, range=1..31)

start_hour = Slider(11, range=0..23)
end_hour = Slider(16, range=0..23)

# ----
# Analyze Sunhours
grid_size = Slider(1, range=0.1..1000)

# ----
# Hour of the Year (HOY)
month = Slider(7, range=1..12)
day = Slider(11, range=1..31)
hour = Slider(13, range=0..23)
minute = Slider(23, range=0..60)

# ----
# Ladybug weather URL
panel = Panel("https://energyplus-weather.s3.amazonaws.com/north_and_central_america_wmo_region_4/USA/NY/USA_NY_New.York.City-Central.Park.744860_TMY2/USA_NY_New.York.City-Central.Park.744860_TMY2.zip")

geometry_pipeline = GeometryPipeline(
    GroupByLayer=False,
    GroupByType=False,
    IncludeHidden=True,
    IncludeLocked=True,
    LayerFilter="panel-locations",
    NameFilter="*",
    SublayerFiltering=True,
    TypeFilter=1)

# ----
# Context Geometry
geometry_pipeline_2 = GeometryPipeline(
    GroupByLayer=False,
    GroupByType=False,
    IncludeHidden=True,
    IncludeLocked=True,
    LayerFilter="Buildings",
    NameFilter="*",
    SublayerFiltering=True,
    TypeFilter=1073741880)

# ----
# Analyze Incident Radiation
boolean_toggle = BooleanToggle(True)

geometry_pipeline_3 = GeometryPipeline(
    GroupByLayer=False,
    GroupByType=False,
    IncludeHidden=True,
    IncludeLocked=True,
    LayerFilter="Analysis Surface",
    NameFilter="*",
    SublayerFiltering=True,
    TypeFilter=1073741848)

grid_size_2 = Slider(0.1, range=0.1..1000)

geometry_pipeline_4 = GeometryPipeline(
    GroupByLayer=False,
    GroupByType=False,
    IncludeHidden=True,
    IncludeLocked=True,
    LayerFilter="solar-panels",
    NameFilter="*",
    SublayerFiltering=True,
    TypeFilter=1073741848)

# ----
# Layer Names
panel_2 = Panel("Analysis Surface")
panel_3 = Panel("layer-name")
panel_4 = Panel("Buildings")
panel_5 = Panel("solar-panels")

# ----
# 1. Make Rhino Layers
button = Button()

# ----
# Set Sunpath Center
panel_6 = Panel("0")
construct_point = ConstructPoint(XCoordinate=panel_6, YCoordinate=panel_6, ZCoordinate=panel_6)
scale = Slider(3, range=0..100)
point = Point()
center_pt = Point(construct_point)

# ----
# 2. Analysis Period
panel_7 = Panel("2025")

merge = Merge(Data1=panel_4, Data2=panel_5, Data3=panel_2)
python_3_script = Python3Script(x=merge)  # -> r, g, b; inputs x: list
# ---------- python_3_script: Python ----------
import random

l = len(x)

r = []
g = []
b = []

def rand_value():
    t = random.randint(0, 255)
    return t

for i in range(l):
    r.append(rand_value())
    g.append(rand_value())
    b.append(rand_value())

print(r)
print(g)
print(b)
# ---------- end python_3_script ----------
colour_rgb = ColourRGB(Alpha=255, Red=python_3_script.r, Green=python_3_script.g, Blue=python_3_script.b)
create_layers = CreateLayers(CreateToggle=button, LayerNames=merge, LayerColors=colour_rgb)

point_2 = Point(<point referenced from the Rhino model>)
mesh_brep = MeshBrep(
    Brep=geometry_pipeline_2,
    Settings={GridMaxCount=0, GridMinCount=16, JaggedSeams=False, MaxEdgeLength=0, MinEdgeLength=0.0001, MinTolerance=0, Refine=True, RefineAngle=0, RelativeTolerance=0.65, SimplePlanes=True, Tolerance=0})
panel_8 = Panel(geometry_pipeline_2)

python_3_script_2 = Python3Script(start_month=start_month, end_month=end_month, start_day=start_day, end_day=end_day, year=panel_7)  # -> total_days
# ---------- python_3_script_2: Python ----------
from datetime import date

# Make sure inputs are integers
y = int(year)
sm = int(start_month)
sd = int(start_day)
em = int(end_month)
ed = int(end_day)

# Build datetime.date objects
start_date = date(y, sm, sd)
end_date = date(y, em, ed)

# Calculate difference
delta = end_date - start_date
total_days = delta.days + 1   # include both start and end dates

print(total_days)
# ---------- end python_3_script_2 ----------
analysisperiod = LBAnalysisPeriod(
    start_month=start_month,
    start_day=start_day,
    start_hour=start_hour,
    end_month=end_month,
    end_day=end_day,
    end_hour=end_hour)  # -> period, hoys, dates; plug-in component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
hoy = LBCalculateHOY(month=month, day=day, hour=hour, minute=minute)  # -> flatten(hoy), flatten(doy), flatten(date); plug-in component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

# ----
# Create Sunpath
downloadepw = LBDownloadWeather(weather_URL=panel)  # -> epw_file, stat_file, ddy_file; plug-in component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
importloc = LBImportLocation(epw_file=downloadepw.epw_file)  # -> location; plug-in component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
sunpath = LBSunPath(location=importloc, hoys=analysisperiod.hoys, center_pt=center_pt, scale=scale)  # -> out, vectors, altitudes, azimuths, hoys, sun_pts, analemma, daily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; plug-in component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

surface = Surface(<surface referenced from the Rhino model>)
unit_z = UnitZ(Factor=Slider(1, range=0..1000))

# ----
# Sky Matrix
importepw = LBImportEPW(epw_file=downloadepw.epw_file)  # -> location, dry_bulb_temperature, dew_point_temperature, relative_humidity, wind_speed, wind_direction, direct_normal_rad, diffuse_horizontal_rad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; plug-in component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
skymatrix = LBCumulativeSkyMatrix(
    location=importloc,
    direct_rad=importepw.direct_normal_rad,
    diffuse_rad=importepw.diffuse_horizontal_rad,
    hoys=analysisperiod.hoys)  # -> out, sky_mtx; plug-in component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

divide_surface = DivideSurface(Surface=surface, UCount=Slider(7, range=0..10), VCount=10)  # -> Points, Normals, Parameters
orient = Orient(Geometry=geometry_pipeline_4, Source=point_2, Target=divide_surface.Points)  # -> Geometry, Transform
move = Move(Geometry=orient.Geometry, Motion=unit_z)  # -> flatten(Geometry), Transform

# ----
# Direct Sun Hours
directsunhours = LBDirectSunHours(
    vectors=flatten(sunpath.vectors),
    geometry=flatten(geometry_pipeline_3),
    context=flatten(mesh_brep),
    grid_size=grid_size,
    run=Toggle(False))  # -> out, points, results, mesh, legend, title, int_mtx; plug-in component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
number = Number(flatten(directsunhours.results))
panel_9 = Panel(directsunhours.results)
python_3_script_3 = Python3Script(x=number, num_days=python_3_script_2)  # -> avg, max_hrs, percent_sun, daily_avg; inputs x: list
# ---------- python_3_script_3: Python ----------
print(x)
l = len(x)
t = 0

for i in range(l):
    t = t + x[i]

avg = t / l
avg = round(avg, 2)

max_hrs = max(x)

print(avg)
print(max_hrs)

percent_sun = 100 * avg / max_hrs

# print with % sign, formatted to 2 decimal places
print(f"{percent_sun:.2f}%")

daily_avg = avg / num_days
# ---------- end python_3_script_3 ----------
python_3_script_4 = Python3Script(
    num_days=python_3_script_2,
    x=python_3_script_3.avg,
    y=python_3_script_3.max_hrs,
    z=python_3_script_3.percent_sun,
    u=python_3_script_3.daily_avg)  # -> a, b, c, d, avg_daily
# ---------- python_3_script_4: Python ----------
# Build the strings
a = f"Average sunhours (entire duration) = {x:.2f}"
b = f"Maximum possible sunhours = {y:.2f}"
c = f"Percentage of sunhours experienced = {z:.2f}%"
d = f"Days of analysis = {num_days}"
avg_daily = f"Daily average sunhours = {u:.2f}"

# Print them
print(a)
print(b)
print(c)
print(d)
print(avg_daily)
# ---------- end python_3_script_4 ----------

# ----
# Incident Radiation
incidentradiation = LBIncidentRadiation(
    sky_mtx=skymatrix.sky_mtx,
    geometry=flatten(geometry_pipeline_4),
    context=flatten(mesh_brep),
    grid_size=grid_size_2,
    run=boolean_toggle)  # -> out, points, results, total, mesh, legend, title, int_mtx; plug-in component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
python_3_script_5 = Python3Script(num_days=python_3_script_2, x=incidentradiation.total)  # -> incident, avg_daily, d
# ---------- python_3_script_5: Python ----------
# Build the strings
incident = f"Total incident radiation = {x:.2f} kWh"

daily_avg = x / num_days
avg_daily = f"Average daily incident radiation = {daily_avg:.2f} kWh"

d = f"Days of analysis = {num_days}"

print(num_days)

# Print them
print(incident)
print(avg_daily)
# ---------- end python_3_script_5 ----------

# ----
# 2. Incident Radiation
panel_10 = Panel(python_3_script_5.d)
panel_11 = Panel(python_3_script_5.avg_daily)
panel_12 = Panel(python_3_script_5.incident)

# ----
# 1. Sunhours
panel_13 = Panel(python_3_script_4.d)
panel_14 = Panel(python_3_script_4.a)
panel_15 = Panel(python_3_script_4.avg_daily)
panel_16 = Panel(python_3_script_4.b)
panel_17 = Panel(python_3_script_4.c)
