# Grasshopper definition camera.gh (Grasshopper 1.0.8)

point = Point(<point referenced from the Rhino model>)
point_2 = Point(<point referenced from the Rhino model>)
point_3 = Point(<point referenced from the Rhino model>)
point_4 = Point(<point referenced from the Rhino model>)
vector_2pt = Vector2Pt(PointA=point, PointB=point_2, Unitize=False)  # -> Vector, Length
vector_2pt_2 = Vector2Pt(PointA=point_3, PointB=point_4, Unitize=False)  # -> Vector, Length

# ----
# set camera location
# set camera direction
merge_points = Merge(Data1=point, Data2=point_3)
merge_vectors = Merge(Data1=vector_2pt.Vector, Data2=vector_2pt_2.Vector)

width_px = Slider(1600, range=0..10000)
perspective = BooleanToggle(True)
height = Panel("9")
width = Panel("16")
lens_mm = Panel("50")
folder_path = Panel("C:\Users\Varun SA\Documents\computational-modelling\4-network-target-view\images")
file_basename = Panel("shot")

division = Division(A=width, B=height)
unit_z = UnitZ(Factor=1)
point_5 = Point(merge_points)
vector = Vector(merge_vectors)
number = Number(division)

# ----
# Camera
click_photo = Button()
python_3_script = Python3Script(
    pt=point_5,
    direction=vector,
    up=unit_z,
    aspect=number,
    width=width_px,
    persp=perspective,
    lens=lens_mm,
    folder=folder_path,
    basename=file_basename,
    shoot=click_photo)  # -> out, ok, filepath; inputs pt: Point3d, direction: Vector3d, up: Vector3d, persp: Boolean
# ---------- python_3_script: Python ----------
import os
import Rhino
import System.Drawing as SD

ok = False
filepath = None

# ensure lens is float
lens = float(lens)
print("Lens length:", lens)

def next_filename(dirpath, base, ext=".png"):
    """
    Returns next available path like dirpath/baseN.ext where N starts at 1.
    Example: shot1.png, shot2.png, ...
    """
    if not os.path.isdir(dirpath):
        os.makedirs(dirpath)
    n = 1
    while True:
        fn = "{}{}{}".format(base, n, ext)
        full = os.path.join(dirpath, fn)
        if not os.path.exists(full):
            return full
        n += 1

if shoot:
    view = Rhino.RhinoDoc.ActiveDoc.Views.ActiveView
    vp   = view.ActiveViewport

    # --- remember old state ---
    old_size = view.Size
    old_loc  = vp.CameraLocation
    old_dir  = vp.CameraDirection
    old_up   = vp.CameraUp
    was_persp = vp.IsPerspectiveProjection
    old_lens  = vp.Camera35mmLensLength

    try:
        # --- set camera pose ---
        vp.SetCameraLocation(pt, True)
        vp.SetCameraDirection(direction, True)
        if up:
            vp.CameraUp = up

        # --- projection / lens ---
        if persp:
            vp.ChangeToPerspectiveProjection(True, lens)
        else:
            vp.ChangeToParallelProjection(True)

        # --- viewport size from aspect ---
        w = int(width)
        h = max(1, int(round(w / float(aspect))))
        view.Size = SD.Size(w, h)
        view.Redraw()

        # --- capture ---
        vc = Rhino.Display.ViewCapture()
        vc.Width = w
        vc.Height = h
        vc.ScaleScreenItems = False
        vc.DrawAxes = False
        vc.DrawGrid = False
        vc.DrawGridAxes = False

        bmp = vc.CaptureToBitmap(view)
        if bmp:
            filepath = next_filename(folder, basename, ".png")
            bmp.Save(filepath, SD.Imaging.ImageFormat.Png)
            ok = True
            ghenv.Component.Message = "Saved: " + os.path.basename(filepath)
        else:
            ghenv.Component.Message = "Capture failed"

    finally:
        # --- restore old state ---
        view.Size = old_size
        if was_persp:
            vp.ChangeToPerspectiveProjection(True, old_lens)
        else:
            vp.ChangeToParallelProjection(True)
        vp.SetCameraLocation(old_loc, True)
        vp.SetCameraDirection(old_dir, True)
        vp.CameraUp = old_up
        view.Redraw()
else:
    ghenv.Component.Message = "Ready"
# ---------- end python_3_script ----------
panel = Panel(python_3_script.filepath)
