# Grasshopper definition target-view-network.gh (Grasshopper 1.0.8)
# plug-ins: CORE.Toolbox.Grasshopper, Bifocals, LunchBox, LadybugGrasshopper

# ----
# 1. Create Layers
button = Button()

width_px = Slider(1600, range=0..10000)
perspective = BooleanToggle(True)
height = Panel("9")
# 4. Camera Settings
width = Panel("16")
lens_mm = Panel("35")
folder_path = Panel("C:\Users\Varun SA\Documents\computational-modelling\4-network-target-view\images")
file_basename = Panel("shot")

# ----
# 2. Input Geometry
geometry_pipeline = GeometryPipeline(
    GroupByLayer=False,
    GroupByType=False,
    IncludeHidden=True,
    IncludeLocked=True,
    LayerFilter="analysis",
    NameFilter="*",
    SublayerFiltering=True,
    TypeFilter=1073741880)
subdivision_size = Panel("75")

# ----
# 3. Run Analysis
lb_falsestart_toggle = LBFalseStartToggle(True)

geometry_pipeline_2 = GeometryPipeline(
    GroupByLayer=False,
    GroupByType=False,
    IncludeHidden=True,
    IncludeLocked=True,
    LayerFilter="context",
    NameFilter="*",
    SublayerFiltering=True,
    TypeFilter=1073741880)

click_photo = Button()
# 4. View Images
focus_point = Point(graft(<point referenced from the Rhino model>))

merge = Merge(Data1="context", Data2="analysis", Data3="path")
python_3_script = Python3Script(x=merge)  # -> r, g, b; inputs x: list
# ---------- python_3_script: Python ----------
import random

l = len(x)

r = []
g = []
b = []

def rand_value():
    t = random.randint(0, 255)
    return t

for i in range(l):
    r.append(rand_value())
    g.append(rand_value())
    b.append(rand_value())

print(r)
print(g)
print(b)
# ---------- end python_3_script ----------
colour_rgb = ColourRGB(Alpha=255, Red=python_3_script.r, Green=python_3_script.g, Blue=python_3_script.b)
create_layers = CreateLayers(CreateToggle=button, LayerNames=merge, LayerColors=colour_rgb)

python_3_script_2 = Python3Script(x=geometry_pipeline, run=lb_falsestart_toggle)  # -> a
# ---------- python_3_script_2: Python ----------
if run == True:
    a = x
else:
    a = null
# ---------- end python_3_script_2 ----------

brep = Brep(flatten(python_3_script_2))
int_subdivision_size = Integer(subdivision_size)
deconstruct_brep = DeconstructBrep(Brep=brep)  # -> Faces, Edges, Vertices
srf_open_space = Surface(deconstruct_brep.Faces)
srf_for_subdivision = Surface(graft(srf_open_space))
# Prepare Geometry for Analysis
dimensions = Dimensions(Surface=srf_for_subdivision)  # -> UDimension, VDimension
division = Division(A=dimensions.UDimension, B=int_subdivision_size)
division_2 = Division(A=dimensions.VDimension, B=int_subdivision_size)
divide_domain² = DivideDomain²(Domain=srf_for_subdivision, UCount=division, VCount=division_2)
isotrim = Isotrim(Surface=srf_for_subdivision, Domain=divide_domain²)
srf_analysis_surfaces = Surface(isotrim)
evaluate_surface = EvaluateSurface(Surface=reparameterize(srf_analysis_surfaces), Point="{0.5,0.5,0}")  # -> Point, Normal, UDirection, VDirection, Frame

analysis_geometry = Geometry(flatten(brep))
context_geometry = Geometry(flatten(geometry_pipeline_2))
volume = Volume(Geometry=analysis_geometry)  # -> Volume, Centroid
point = Point(flatten(volume.Centroid))
scale = Scale(Geometry=analysis_geometry, Center=point, Factor=".98")  # -> Geometry, Transform
# Context Geometry
geometry = Geometry(flatten(scale.Geometry))
merge_2 = Merge(Data1=geometry, Data2=context_geometry)
mesh_join = MeshJoin(Meshes=flatten(merge_2))
colour_rgb_2 = ColourRGB(Alpha=255, Red=Slider(237, range=0..255), Green=Slider(240, range=0..255), Blue=Slider(255, range=0..255))
set_material = SetMaterial(DiffuseColor=colour_rgb_2)  # -> Attribute, PBRMaterial
panel = Panel(mesh_join)
custom_preview = CustomPreview(Geometry=context_geometry, Material=set_material.PBRMaterial)

number_slider = Slider(15, range=0..100)
geometry_pipeline_3 = GeometryPipeline(
    GroupByLayer=False,
    GroupByType=False,
    IncludeHidden=True,
    IncludeLocked=True,
    LayerFilter="path",
    NameFilter="*",
    SublayerFiltering=True,
    TypeFilter=4)

viewing_path_curve = Curve(flatten(geometry_pipeline_3))
# Divide Path Curve to get Viewpoints
divide_curve = DivideCurve(Curve=viewing_path_curve, Count=number_slider, Kinks=False)  # -> Points, Tangents, Parameters
addition = Addition(A=number_slider, B="1")
point_2 = Point(graft(divide_curve.Points))
panel_2 = Panel(point_2)

number_of_viewing_points = Panel(addition)

point_3 = Point(simplify(point_2))
panel_3 = Panel(point_3)
vector_2pt = Vector2Pt(PointA=point_3, PointB=focus_point, Unitize=False)  # -> simplify(Vector), Length
panel_4 = Panel(vector_2pt.Vector)

division_3 = Division(A=width, B=height)
unit_z = UnitZ(Factor=1)
# Camera
point_4 = Point(point_3)
vector = Vector(vector_2pt.Vector)
number = Number(division_3)

python_3_script_3 = Python3Script(
    pt=point_4,
    direction=vector,
    up=unit_z,
    aspect=number,
    width=width_px,
    persp=perspective,
    lens=lens_mm,
    folder=folder_path,
    basename=file_basename,
    shoot=click_photo)  # -> out, ok, filepath; inputs pt: Point3d, direction: Vector3d, up: Vector3d, persp: Boolean
# ---------- python_3_script_3: Python ----------
import os
import Rhino
import System.Drawing as SD

ok = False
filepath = None

# ensure lens is float
lens = float(lens)
print("Lens length:", lens)

def next_filename(dirpath, base, ext=".png"):
    """
    Returns next available path like dirpath/baseN.ext where N starts at 1.
    Example: shot1.png, shot2.png, ...
    """
    if not os.path.isdir(dirpath):
        os.makedirs(dirpath)
    n = 1
    while True:
        fn = "{}{}{}".format(base, n, ext)
        full = os.path.join(dirpath, fn)
        if not os.path.exists(full):
            return full
        n += 1

if shoot:
    view = Rhino.RhinoDoc.ActiveDoc.Views.ActiveView
    vp   = view.ActiveViewport

    # --- remember old state ---
    old_size = view.Size
    old_loc  = vp.CameraLocation
    old_dir  = vp.CameraDirection
    old_up   = vp.CameraUp
    was_persp = vp.IsPerspectiveProjection
    old_lens  = vp.Camera35mmLensLength

    try:
        # --- set camera pose ---
        vp.SetCameraLocation(pt, True)
        vp.SetCameraDirection(direction, True)
        if up:
            vp.CameraUp = up

        # --- projection / lens ---
        if persp:
            vp.ChangeToPerspectiveProjection(True, lens)
        else:
            vp.ChangeToParallelProjection(True)

        # --- viewport size from aspect ---
        w = int(width)
        h = max(1, int(round(w / float(aspect))))
        view.Size = SD.Size(w, h)
        view.Redraw()

        # --- capture ---
        vc = Rhino.Display.ViewCapture()
        vc.Width = w
        vc.Height = h
        vc.ScaleScreenItems = False
        vc.DrawAxes = False
        vc.DrawGrid = False
        vc.DrawGridAxes = False

        bmp = vc.CaptureToBitmap(view)
        if bmp:
            filepath = next_filename(folder, basename, ".png")
            bmp.Save(filepath, SD.Imaging.ImageFormat.Png)
            ok = True
            ghenv.Component.Message = "Saved: " + os.path.basename(filepath)
        else:
            ghenv.Component.Message = "Capture failed"

    finally:
        # --- restore old state ---
        view.Size = old_size
        if was_persp:
            vp.ChangeToPerspectiveProjection(True, old_lens)
        else:
            vp.ChangeToParallelProjection(True)
        vp.SetCameraLocation(old_loc, True)
        vp.SetCameraDirection(old_dir, True)
        vp.CameraUp = old_up
        view.Redraw()
else:
    ghenv.Component.Message = "Ready"
# ---------- end python_3_script_3 ----------
panel_5 = Panel(python_3_script_3.filepath)

point_5 = Point(flatten(evaluate_surface.Point))
# Occlusion
line = Line(StartPoint=point_2, EndPoint=point_5)
vector_2 = Vector(flatten(line))
occlusion = Occlusion(Samples=point_5, Obstructions=mesh_join, Rays=vector_2)  # -> Hits, simplify(Occlusion)
surface = Surface(flatten(srf_analysis_surfaces))

panel_6 = Panel(occlusion.Hits)
list_length_py = Python3Script(x=vector_2)  # -> a; inputs x: list
# ---------- list_length_py: Python ----------
a = len(x)

print(a)
# ---------- end list_length_py ----------
subtraction = Subtraction(A=list_length_py, B=occlusion.Hits)
panel_7 = Panel(list_length_py)
addition_2 = Addition(A=subtraction, B="1")
panel_8 = Panel(addition_2)
# Visualization
panel_9 = Panel("0")
gradient = Gradient(
    LowerLimit=panel_9,
    UpperLimit=list_length_py,
    Parameter=addition_2,
    stops=[0: RGB(0, 128, 128), 0.355: RGB(255, 255, 0), 0.698: RGB(255, 0, 0)])
col_view_analysis_color = Colour(gradient)
custom_preview_2 = CustomPreview(Geometry=surface, Material=col_view_analysis_color)
