# Grasshopper definition intro to gh.gh (Grasshopper 1.0.8)

geometry_pipeline = GeometryPipeline(
    GroupByLayer=False,
    GroupByType=False,
    IncludeHidden=True,
    IncludeLocked=True,
    LayerFilter="Default",
    NameFilter="*",
    SublayerFiltering=True,
    TypeFilter=1)
number_slider = Slider(4453, range=100..10000)
point = Point(geometry_pipeline)
python_3_script = Python3Script(x=number_slider, y=Slider(408, range=100..1000))  # -> out, a
# ---------- python_3_script: Python ----------
a = x / y
a = int(a)

print(a)
# ---------- end python_3_script ----------
circle = Circle(Plane=point, Radius=number_slider)
divide_curve = DivideCurve(Curve=circle, Count=python_3_script.a, Kinks=False)  # -> Points, Tangents, Parameters
circle_2 = Circle(Plane=divide_curve.Points, Radius=number_slider)
