# Grasshopper definition Climate Analysis.gh (Grasshopper 1.0.7)
# plug-ins: ClimateStudioGH, glTFexporter

start_hour = Panel("7")
start_day = Panel("305")
end_day = Panel("74")
end_hour = Panel("20")
y_axis_5_default = Panel("15")
start_speed = Panel("3.5")
start_day_2 = Panel("0")
end_day_2 = Panel("364")
start_hour_2 = Panel("0")
end_hour_2 = Panel("24")
y_axis_5_default_2 = Panel("10")
start_speed_2 = Panel("0")
templates = CSWorkflowTemplates()
weathersearch = SearchForWeather(
    Selection="C:\Users\lwilson\AppData\Roaming\Solemma\ClimateStudio\WeatherFiles\USA_NY_New.York-Central.Park.Obs-Belvedere.Castle.725053_TMYx.2004-2018.epw",
    UnitSystem=4)
nickname = RelativePath()

# ----
# Load Weather Data
weather = Weather(
    Location=weathersearch,
    Input_0_Hidden=False,
    Input_0_Name="Location",
    Output_0_Hidden=False,
    Output_0_Name="Location",
    Output_10_Hidden=False,
    Output_10_Name="DiffuseHorizontalRadiation",
    Output_11_Hidden=True,
    Output_11_Name="GlobalHorizontalRadiation",
    Output_12_Hidden=True,
    Output_12_Name="SkyCover",
    Output_13_Hidden=True,
    Output_13_Name="Precipitation",
    Output_14_Hidden=False,
    Output_14_Name="Elev",
    Output_15_Hidden=True,
    Output_15_Name="Azimuth",
    Output_16_Hidden=True,
    Output_16_Name="Vector",
    Output_17_Hidden=True,
    Output_17_Name="Illuminance",
    Output_18_Hidden=True,
    Output_18_Name="DateTime",
    Output_19_Hidden=True,
    Output_19_Name="DryBulbAverages",
    Output_1_Hidden=True,
    Output_1_Name="Latitude",
    Output_20_Hidden=True,
    Output_20_Name="DewPointAverages",
    Output_21_Hidden=True,
    Output_21_Name="DryBulbMinima"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)  # -> Location, DryBulbTemp, RelativeHumidity, WindSpeed, DirectNormalRadiation, DiffuseHorizontalRadiation, Elev

windrose = WindRosePlotter(
    PNGOrPDF="PNG",
    Directory=nickname,
    FileName="\New York",
    Width=1000,
    Height=700,
    WeatherFileLocation=weathersearch,
    CreatePlot=Toggle(False),
    StartDay=start_day_2,
    EndDay=end_day_2,
    StartHour=start_hour_2,
    EndHour=end_hour_2,
    StartSpeed=start_speed_2,
    YAxisMax=y_axis_5_default_2,
    Input_0_Hidden=False,
    Input_0_Name="PNG or PDF",
    Input_10_Hidden=False,
    Input_10_Name="End Day",
    Input_11_Hidden=False,
    Input_11_Name="Start Hour",
    Input_12_Hidden=False,
    Input_12_Name="End Hour",
    Input_13_Hidden=False,
    Input_13_Name="Start Speed",
    Input_14_Hidden=True,
    Input_14_Name="End Speed",
    Input_15_Hidden=True,
    Input_15_Name="Start Temp",
    Input_16_Hidden=True,
    Input_16_Name="End Temp",
    Input_17_Hidden=True,
    Input_17_Name="Start Humidity",
    Input_18_Hidden=True,
    Input_18_Name="End Humidity",
    Input_19_Hidden=True,
    Input_19_Name="Start UTCI",
    Input_1_Hidden=False,
    Input_1_Name="Directory",
    Input_20_Hidden=True,
    Input_20_Name="End UTCI",
    Input_21_Hidden=True,
    Input_21_Name="Use UTCI",
    Input_22_Hidden=True,
    Input_22_Name="SubDibision Angle"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)

# ----
# Project to horizontal
int_dirnormrad = Integer(weather.DirectNormalRadiation)
int_diffhorrad = Integer(weather.DiffuseHorizontalRadiation)
cluster = Cluster(A=int_dirnormrad, B=int_diffhorrad)
int_projected_radiation = Integer(cluster)

very_strong_heat_stress = ColourSwatch(SwatchColor=RGB(204, 0, 0))
very_strong_cold_stress = ColourSwatch(SwatchColor=RGB(0, 0, 191))
moderate_heat_stress = ColourSwatch(SwatchColor=RGB(255, 102, 0))
moderate_cold_stress = ColourSwatch(SwatchColor=RGB(0, 98, 255))
extreme_heat_stress = ColourSwatch(SwatchColor=RGB(128, 0, 0))
extreme_cold_stress = ColourSwatch(SwatchColor=RGB(0, 0, 128))
strong_heat_stress = ColourSwatch(SwatchColor=RGB(255, 51, 0))
strong_cold_stress = ColourSwatch(SwatchColor=RGB(0, 0, 255))
no_thermal_stress = ColourSwatch(SwatchColor=RGB(0, 191, 0))
slight_heat_stress = ColourSwatch(SwatchColor=RGB(255, 234, 0))
slight_cold_stress = ColourSwatch(SwatchColor=RGB(0, 191, 255))
merge = Merge(
    Data1=extreme_heat_stress,
    Data2=very_strong_heat_stress,
    Data3=strong_heat_stress,
    Data4=moderate_heat_stress,
    Data5=slight_heat_stress,
    Data6=no_thermal_stress,
    Data7=slight_cold_stress,
    Data8=moderate_cold_stress,
    Data9=strong_cold_stress,
    Data10=very_strong_cold_stress,
    Data11=extreme_cold_stress)
rev = ReverseList(List=merge)
gradient = ConstructCSGradient(Colors=rev, Steps="11", UnitSystem=4)
dom = ConstructDomain(DomainStart="-5", DomainEnd="5")
falsecolor = ConstructCSFalsecolor(GradientS=gradient, DomainS=dom, UnitSystem=4)
hours_max = Panel("650")
data_false_color_map = Data(falsecolor)
txt_months = Text(["Jan", "Feb", "Mar", "Apr", "May", "Jun", "Jul", "Aug", "Sept", "Oct", "Nov", "Dec"])
txt_months_2 = Text(["Jan", "Feb", "Mar", "Apr", "May", "Jun", "Jul", "Aug", "Sept", "Oct", "Nov", "Dec"])
txt_months_3 = Text(["Jan", "Feb", "Mar", "Apr", "May", "Jun", "Jul", "Aug", "Sept", "Oct", "Nov", "Dec"])

# ----
# Outdoor Comfort (UTCI)
int_projected_radiation_2 = Integer(int_projected_radiation)
num_wind_speed = Number(weather.WindSpeed)
int_dirnormrad_2 = Integer(int_dirnormrad)

# ----
# Sun
list = ValueList({"Shaded": 0, "No Shade": 1}, selected="Shaded")
multiplication = Multiplication(A=int_projected_radiation_2, B=list)

# ----
# Wind
list_2 = ValueList({"Protected": 0, "Exposed": 1}, selected="Exposed")
multiplication_2 = Multiplication(A=num_wind_speed, B=list_2)

utci = CSUTCICalculator(
    Temperature=weather.DryBulbTemp,
    RelativeHumidity=weather.RelativeHumidity,
    WindSpeed=multiplication_2,
    DiffuseRadiation=int_dirnormrad_2,
    DirectRadiation=multiplication,
    SunElevation=weather.Elev,
    TemperatureContext=weather.DryBulbTemp,
    StreetWidth=30,
    StreetHeight=30,
    BodyAbsorption=0.5,
    GroundReflectance=0.2)  # -> UTCI, Condition

cluster_2 = Cluster_2(num_utci=utci.Condition)  # -> int_heat_stress_hours_2, int_cold_stress_hours_2, int_comfort_hours_2, txt_months_2, int_y_data_2, txt_comfort_labels_2, col_lines_2
num_utci = Number(utci.Condition)

# ----
# Exposed Wind | Shaded
int_cold_stress_hours = Integer(cluster_2.int_cold_stress_hours_2)
int_comfort_hours = Integer(cluster_2.int_comfort_hours_2)
int_hours_max = Integer(hours_max)
txt_months_4 = Text(["Jan", "Feb", "Mar", "Apr", "May", "Jun", "Jul", "Aug", "Sept", "Oct", "Nov", "Dec"])
int_y_data = Integer(cluster_2.int_y_data_2)
num_utci_2 = Number(num_utci)
int_heat_stress_hours = Integer(cluster_2.int_heat_stress_hours_2)
col_lines = Colour(cluster_2.col_lines_2)
txt_comfort_labels = Text(cluster_2.txt_comfort_labels_2)
plotter = CSPlotter(
    Type=0,
    Width=550,
    Height=450,
    X_labels=txt_months_4,
    X_rot=90,
    Y_data=int_y_data,
    Colors=col_lines,
    Names=txt_comfort_labels,
    Range=int_hours_max,
    Grid_x=1,
    Show_xgrid=False,
    Show_ygrid=True,
    Legend=0)
plothr = CSPlotHourlyData(
    Data=num_utci_2,
    Falsecolor=data_false_color_map,
    Input_0_Hidden=False,
    Input_0_Name="Data",
    Input_1_Hidden=False,
    Input_1_Name="Falsecolor",
    Input_2_Hidden=False,
    Input_2_Name="File Path",
    UnitSystem=4)
hours_in_cold_stress = Panel(int_cold_stress_hours)
annual_comfort_hours = Panel(int_comfort_hours)

hours_in_heat_stress = Panel(int_heat_stress_hours)

# ----
# Outdoor Comfort (UTCI)
int_projected_radiation_3 = Integer(int_projected_radiation)
num_wind_speed_2 = Number(weather.WindSpeed)
int_dirnormrad_3 = Integer(int_dirnormrad)

# ----
# Sun
list_3 = ValueList({"Shaded": 0, "No Shade": 1}, selected="Shaded")
multiplication_3 = Multiplication(A=int_projected_radiation_3, B=list_3)

# ----
# Wind
list_4 = ValueList({"Protected": 0, "Exposed": 1}, selected="Protected")
multiplication_4 = Multiplication(A=num_wind_speed_2, B=list_4)

utci_2 = CSUTCICalculator(
    Temperature=weather.DryBulbTemp,
    RelativeHumidity=weather.RelativeHumidity,
    WindSpeed=multiplication_4,
    DiffuseRadiation=int_dirnormrad_3,
    DirectRadiation=multiplication_3,
    SunElevation=weather.Elev,
    TemperatureContext=weather.DryBulbTemp,
    StreetWidth=30,
    StreetHeight=30,
    BodyAbsorption=0.5,
    GroundReflectance=0.2)  # -> UTCI, Condition

cluster_3 = Cluster_2(num_utci=utci_2.Condition)  # -> int_heat_stress_hours_2, int_cold_stress_hours_2, int_comfort_hours_2, txt_months_2, int_y_data_2, txt_comfort_labels_2, col_lines_2
num_utci_3 = Number(utci_2.Condition)

# ----
# No Wind | Shaded
int_cold_stress_hours_2 = Integer(cluster_3.int_cold_stress_hours_2)
int_comfort_hours_2 = Integer(cluster_3.int_comfort_hours_2)
int_y_data_2 = Integer(cluster_3.int_y_data_2)
txt_comfort_labels_2 = Text(cluster_3.txt_comfort_labels_2)
num_utci_4 = Number(num_utci_3)
int_heat_stress_hours_2 = Integer(cluster_3.int_heat_stress_hours_2)
int_hours_max_2 = Integer(int_hours_max)
col_lines_2 = Colour(cluster_3.col_lines_2)
plotter_2 = CSPlotter(
    Type=0,
    Width=550,
    Height=450,
    X_labels=txt_months,
    X_rot=90,
    Y_data=int_y_data_2,
    Colors=col_lines_2,
    Names=txt_comfort_labels_2,
    Range=int_hours_max_2,
    Grid_x=1,
    Show_xgrid=False,
    Show_ygrid=True,
    Legend=0)
plothr_2 = CSPlotHourlyData(
    Data=num_utci_4,
    Falsecolor=data_false_color_map,
    Input_0_Hidden=False,
    Input_0_Name="Data",
    Input_1_Hidden=False,
    Input_1_Name="Falsecolor",
    Input_2_Hidden=False,
    Input_2_Name="File Path",
    UnitSystem=4)
hours_in_cold_stress_2 = Panel(int_cold_stress_hours_2)
annual_comfort_hours_2 = Panel(int_comfort_hours_2)

hours_in_heat_stress_2 = Panel(int_heat_stress_hours_2)

# ----
# Outdoor Comfort (UTCI)
int_projected_radiation_4 = Integer(int_projected_radiation)
num_wind_speed_3 = Number(weather.WindSpeed)
int_dirnormrad_4 = Integer(int_dirnormrad)

# ----
# Sun
list_5 = ValueList({"Shaded": 0, "No Shade": 1}, selected="No Shade")
multiplication_5 = Multiplication(A=int_projected_radiation_4, B=list_5)

# ----
# Wind
list_6 = ValueList({"Protected": 0, "Exposed": 1}, selected="Exposed")
multiplication_6 = Multiplication(A=num_wind_speed_3, B=list_6)

utci_3 = CSUTCICalculator(
    Temperature=weather.DryBulbTemp,
    RelativeHumidity=weather.RelativeHumidity,
    WindSpeed=multiplication_6,
    DiffuseRadiation=int_dirnormrad_4,
    DirectRadiation=multiplication_5,
    SunElevation=weather.Elev,
    TemperatureContext=weather.DryBulbTemp,
    StreetWidth=30,
    StreetHeight=30,
    BodyAbsorption=0.5,
    GroundReflectance=0.2)  # -> UTCI, Condition

cluster_4 = Cluster_2(num_utci=utci_3.Condition)  # -> int_heat_stress_hours_2, int_cold_stress_hours_2, int_comfort_hours_2, txt_months_2, int_y_data_2, txt_comfort_labels_2, col_lines_2
num_utci_5 = Number(utci_3.Condition)

# ----
# Exposed Wind | No Shade
int_y_data_3 = Integer(cluster_4.int_y_data_2)
int_cold_stress_hours_3 = Integer(cluster_4.int_cold_stress_hours_2)
int_comfort_hours_3 = Integer(cluster_4.int_comfort_hours_2)
num_utci_6 = Number(num_utci_5)
int_heat_stress_hours_3 = Integer(cluster_4.int_heat_stress_hours_2)
int_hours_max_3 = Integer(int_hours_max_2)
col_lines_3 = Colour(cluster_4.col_lines_2)
txt_comfort_labels_3 = Text(cluster_4.txt_comfort_labels_2)
plotter_3 = CSPlotter(
    Type=0,
    Width=550,
    Height=450,
    X_labels=txt_months_2,
    X_rot=90,
    Y_data=int_y_data_3,
    Colors=col_lines_3,
    Names=txt_comfort_labels_3,
    Range=int_hours_max_3,
    Grid_x=1,
    Show_xgrid=False,
    Show_ygrid=True,
    Legend=0)
plothr_3 = CSPlotHourlyData(
    Data=num_utci_6,
    Falsecolor=data_false_color_map,
    Input_0_Hidden=False,
    Input_0_Name="Data",
    Input_1_Hidden=False,
    Input_1_Name="Falsecolor",
    Input_2_Hidden=False,
    Input_2_Name="File Path",
    UnitSystem=4)
hours_in_cold_stress_3 = Panel(int_cold_stress_hours_3)
annual_comfort_hours_3 = Panel(int_comfort_hours_3)

hours_in_heat_stress_3 = Panel(int_heat_stress_hours_3)

# ----
# Outdoor Comfort (UTCI)
int_projected_radiation_5 = Integer(int_projected_radiation)
num_wind_speed_4 = Number(weather.WindSpeed)
int_dirnormrad_5 = Integer(int_dirnormrad)

# ----
# Sun
list_7 = ValueList({"Shaded": 0, "No Shade": 1}, selected="No Shade")
multiplication_7 = Multiplication(A=int_projected_radiation_5, B=list_7)

# ----
# Wind
list_8 = ValueList({"Protected": 0, "Exposed": 1}, selected="Protected")
multiplication_8 = Multiplication(A=num_wind_speed_4, B=list_8)

utci_4 = CSUTCICalculator(
    Temperature=weather.DryBulbTemp,
    RelativeHumidity=weather.RelativeHumidity,
    WindSpeed=multiplication_8,
    DiffuseRadiation=int_dirnormrad_5,
    DirectRadiation=multiplication_7,
    SunElevation=weather.Elev,
    TemperatureContext=weather.DryBulbTemp,
    StreetWidth=30,
    StreetHeight=30,
    BodyAbsorption=0.5,
    GroundReflectance=0.2)  # -> UTCI, Condition

cluster_5 = Cluster_2(num_utci=utci_4.Condition)  # -> int_heat_stress_hours_2, int_cold_stress_hours_2, int_comfort_hours_2, txt_months_2, int_y_data_2, txt_comfort_labels_2, col_lines_2
num_utci_7 = Number(utci_4.Condition)

# ----
# No Wind | No Shade
int_cold_stress_hours_4 = Integer(cluster_5.int_cold_stress_hours_2)
int_comfort_hours_4 = Integer(cluster_5.int_comfort_hours_2)
int_hours_max_4 = Integer(int_hours_max_3)
int_y_data_4 = Integer(cluster_5.int_y_data_2)
num_utci_8 = Number(num_utci_7)
int_heat_stress_hours_4 = Integer(cluster_5.int_heat_stress_hours_2)
col_lines_4 = Colour(cluster_5.col_lines_2)
txt_comfort_labels_4 = Text(cluster_5.txt_comfort_labels_2)
plotter_4 = CSPlotter(
    Type=0,
    Width=550,
    Height=450,
    X_labels=txt_months_3,
    X_rot=90,
    Y_data=int_y_data_4,
    Colors=col_lines_4,
    Names=txt_comfort_labels_4,
    Range=int_hours_max_4,
    Grid_x=1,
    Show_xgrid=False,
    Show_ygrid=True,
    Legend=0)
plothr_4 = CSPlotHourlyData(
    Data=num_utci_8,
    Falsecolor=data_false_color_map,
    Input_0_Hidden=False,
    Input_0_Name="Data",
    Input_1_Hidden=False,
    Input_1_Name="Falsecolor",
    Input_2_Hidden=False,
    Input_2_Name="File Path",
    UnitSystem=4)
hours_in_cold_stress_4 = Panel(int_cold_stress_hours_4)
annual_comfort_hours_4 = Panel(int_comfort_hours_4)

hours_in_heat_stress_4 = Panel(int_heat_stress_hours_4)

# ==== cluster Cluster
B = ClusterInput()
subtraction = Subtraction(A="90", B=B)
rad = Radians(Degrees=subtraction)
A = ClusterInput()
cos = Cosine(Value=rad)
multiplication = Multiplication(A=A, B=cos)
R = ClusterOutput(multiplication)

# ==== cluster Cluster_2
num_utci = ClusterInput()
num_utci_2 = Number(num_utci)

# ----
# Annual Heat Stress
panel = Panel("2")
larger = LargerThan(FirstNumber=num_utci_2, SecondNumber=panel)  # -> LargerThan, OrEqualTo
int = Integer(larger.LargerThan)
ma = MassAddition(Input=int)  # -> Result, PartialResults

# ----
# Annual summary
panel_2 = Panel("-1")
larger_2 = LargerThan(FirstNumber=num_utci_2, SecondNumber=panel_2)  # -> LargerThan, OrEqualTo
smaller = SmallerThan(FirstNumber=num_utci_2, SecondNumber="1")  # -> SmallerThan, OrEqualTo
and = GateAnd(A=larger_2.LargerThan, B=smaller.SmallerThan)
int_2 = Integer(and)
ma_2 = MassAddition(Input=int_2)  # -> Result, PartialResults

# ----
# Annual Cold Stress
panel_3 = Panel("-2")
smaller_2 = SmallerThan(FirstNumber=num_utci_2, SecondNumber=panel_3)  # -> SmallerThan, OrEqualTo
int_3 = Integer(smaller_2.SmallerThan)
ma_3 = MassAddition(Input=int_3)  # -> Result, PartialResults

# ----
# Monthly summary
months = Panel("""Jan
Feb
Mar
Apr
May
Jun
Jul
Aug
Sept
Oct
Nov
Dec""")
num_of_days_in_month = Panel("""31
28
31
30
31
30
31
31
30
31
30
31""")
multiplication = Multiplication(A=num_of_days_in_month, B="24")
strong_heat_stress = ColourSwatch(SwatchColor=RGB(255, 51, 0))
no_thermal_stress = ColourSwatch(SwatchColor=RGB(0, 191, 0))
strong_cold_stress = ColourSwatch(SwatchColor=RGB(0, 0, 255))
partition = PartitionList(List=int_2, Size=multiplication)
partition_2 = PartitionList(List=int_3, Size=multiplication)
partition_3 = PartitionList(List=int, Size=multiplication)
panel_4 = Panel("""Comfort Hours
Cold Stress
Heat Stress""")
entwine = Entwine(Branch00=no_thermal_stress, Branch01=strong_cold_stress, Branch02=strong_heat_stress, FlattenInputs=True)  # -> flatten(Result)
ma_4 = MassAddition(Input=partition)  # -> flatten(Result), PartialResults
ma_5 = MassAddition(Input=partition_2)  # -> flatten(Result), PartialResults
ma_6 = MassAddition(Input=partition_3)  # -> flatten(Result), PartialResults
entwine_2 = Entwine(Branch00=ma_4.Result, Branch01=ma_5.Result, Branch02=ma_6.Result, FlattenInputs=True)

int_heat_stress_hours = Integer(ma.Result)
int_cold_stress_hours = Integer(ma_3.Result)
int_comfort_hours = Integer(ma_2.Result)
int_cold_stress_hours_2 = ClusterOutput(int_cold_stress_hours)
int_comfort_hours_2 = ClusterOutput(int_comfort_hours)
int_heat_stress_hours_2 = ClusterOutput(int_heat_stress_hours)
txt_comfort_labels = Text(panel_4)
col_lines = Colour(entwine)
txt_months = Text(months)
int_y_data = Integer(entwine_2)
col_lines_2 = ClusterOutput(col_lines)
int_y_data_2 = ClusterOutput(int_y_data)
txt_months_2 = ClusterOutput(txt_months)
txt_comfort_labels_2 = ClusterOutput(txt_comfort_labels)
