# Grasshopper definition Deriving Spatial Data_pt2.gh (Grasshopper 1.0.7)
# plug-ins: Geospatial, Triceratops, atit

file_name = Panel("109.shp")
nickname = RelativePath()
concat = Concatenate(FragmentA=nickname, FragmentB="/")
# Import ShapeFile
concat_2 = Concatenate(FragmentA=concat, FragmentB=file_name)

# ---- group: Imports Shape Files and Associate Data
file_path_to_gis_data = FilePath(concat_2)
toggle = BooleanToggle(True)
imp_it = ImpIt(ShapefileShpPath=file_path_to_gis_data, Project2WGS84=False, TrueOrFalse=toggle)  # -> Shapes, Features
datavis_it = DataVisIt(Shapes=imp_it.Shapes, GetValueofFeature=imp_it.Features, TrueOrFalse=toggle)  # -> Polygon, Polyline, Point, AttValues

# ----
data_features = Panel(imp_it.Features)
landuse = Slider(29, range=0..100)
bbl = Slider(71, range=0..100)
landuse_code_for_parks = Panel("09")
item = ListItem(List=datavis_it.AttValues, Index=landuse, Wrap=True)
item_2 = ListItem(List=datavis_it.AttValues, Index=bbl, Wrap=True)
mindex = MemberIndex(Set=item, Member=landuse_code_for_parks)  # -> Index, Count
crv_lots = Curve(datavis_it.Polygon)
int_index_for_parks = Integer(mindex.Index)

# ---- group: Use to join with PLUTO data if needed
int_bbl = Integer(item_2)

# ----
crv_lots_2 = Curve(crv_lots)
item_3 = ListItem(List=int_bbl, Index=int_index_for_parks, Wrap=True)
item_4 = ListItem(List=crv_lots_2, Index=int_index_for_parks, Wrap=True)
int_bbl_of_parks = Integer(item_3)
geo_context = Geometry(<mesh referenced from the Rhino model>)
crv_parks = Curve(item_4)
int_bbl_of_parks_2 = Integer(int_bbl_of_parks)
# Geometry Prep
geo_context_2 = Geometry(geo_context)
crv_parks_2 = Curve(crv_parks)
explode = Explode(Curve=crv_parks_2, Recursive=True)  # -> Segments, Vertices
path_mapper = PathMapper(explode.Vertices, source="{A;B;C}", target="{A;B}")
pull = PullPoint(Point=path_mapper, Geometry=geo_context_2, ClosestOnly=True)  # -> ClosestPoint, Distance
sort = SortList(Keys=pull.Distance, ValuesA=pull.ClosestPoint)  # -> Keys, ValuesA
item_5 = ListItem(List=sort.ValuesA, Index=0, Wrap=True)
project = Project(Geometry=item_5, Plane=PlaneXY(0, 0, 0))  # -> Geometry, Transform
dist = Distance(PointA=project.Geometry, PointB=item_5)
Z = UnitZ(Factor=dist)
move = Move(Geometry=crv_parks_2, Motion=Z)  # -> Geometry, Transform
crv_moved_parks = Curve(move.Geometry)

file_name_2 = Panel("USA_NY_New.York-Central.Park.725033_TMY3.epw")
nickname_2 = RelativePath()
concat_3 = Concatenate(FragmentA=nickname_2, FragmentB="/")
concat_4 = Concatenate(FragmentA=concat_3, FragmentB=file_name_2)

day = Panel("21")
minimum_average_daylight_hours = Panel("4")
months = Panel("2")
start_hour = Panel("8")
subdivision_size = Panel("60")
end_hour = Panel("18")
time_step = Panel("1")
srf_open_space = Surface(crv_moved_parks)
path_epw_file = FilePath(concat_4)
brep_design = Brep([<brep referenced from the Rhino model> x2])  # disabled
mesh_context = Mesh(flatten(geo_context))
cluster = Cluster_2(srf_for_subdivision=srf_open_space, int_subdivision_size=subdivision_size)  # -> srf_analysis_surfaces_3, pt_analysis_points_2
mesh_design = Mesh(flatten(brep_design))  # disabled
mjoin = MeshJoin(Meshes=mesh_context)
merge = Merge(Data1=mjoin, Data2=mesh_design)
# Analysis
mjoin_2 = MeshJoin(Meshes=flatten(merge))

# ----
# Daylight to Streets
cluster_2 = Cluster(
    mesh_obstructions=mjoin_2,
    srf_analysis_surfaces=cluster.srf_analysis_surfaces_3,
    pt_analysis_points=cluster.pt_analysis_points_2,
    path_epw_file=path_epw_file,
    int_months=months,
    int_day=day,
    int_start_hour=start_hour,
    int_end_hour=end_hour,
    int_time_step=time_step,
    minimum_average_daylight_hours=minimum_average_daylight_hours)  # -> srf_analysis_surfaces_4, col_view_analysis_color_2, num_average_daylight_hours_2, num_average_of_day_with_daylight_2, num_above_minimum_daylight_hours_2, int_hours_per_surface_2, num_hours_per_surface_2

multiplication = Multiplication(A=cluster_2.num_above_minimum_daylight_hours_2, B="100")
int = Integer(multiplication)

clean = CleanTree(RemoveNulls=True, RemoveInvalid=True, RemoveEmpty=True, Tree=cluster_2.srf_analysis_surfaces_4)
clean_2 = CleanTree(RemoveNulls=True, RemoveInvalid=True, RemoveEmpty=True, Tree=cluster_2.col_view_analysis_color_2)
viewer = ParamViewer(clean)
viewer_2 = ParamViewer(cluster_2.srf_analysis_surfaces_4)

num_above_minimum_daylight_hours = Number(int)
int_hours_per_surface = Integer(cluster_2.int_hours_per_surface_2)

# ---- group: Data Outputs
average_daylight_hours = Panel(cluster_2.num_average_daylight_hours_2)
average_of_day_with_daylight = Panel(cluster_2.num_average_of_day_with_daylight_2)
above_minimum_daylight_hours = Panel(cluster_2.num_above_minimum_daylight_hours_2)

# ----
num_average_daylight_hours = Number(cluster_2.num_average_daylight_hours_2)
srf_analysis_surfaces = Surface(clean)
# Record Data
srf_open_space_2 = Surface(srf_open_space)

# ---- group: Visualiztion
preview = CustomPreview(Geometry=clean, Material=clean_2)

# ----
num_above_minimum_daylight_hours_2 = Number(num_above_minimum_daylight_hours)
panel = Panel("BBL,Average Daylight Hours,Percent Above minimum daylight hours")
int_bbl_of_parks_3 = Integer(simplify(int_bbl_of_parks_2))
num_average_daylight_hours_2 = Number(num_average_daylight_hours)
merge_2 = Merge(Data1=int_bbl_of_parks_3, Data2=num_average_daylight_hours_2, Data3=num_above_minimum_daylight_hours_2)
clean_3 = CleanTree(RemoveNulls=True, RemoveInvalid=True, RemoveEmpty=True, Tree=merge_2)
join = TextJoin(Text=clean_3, Join=",")  # -> flatten(Result)
merge_3 = Merge(Data1=panel, Data2=join)
panel_2 = Panel(merge_3)
num_above_minimum_daylight_hours_3 = Number(flatten(num_above_minimum_daylight_hours_2))
int_bbl_of_parks_4 = Integer(simplify(flatten(int_bbl_of_parks_3)))
num_average_daylight_hours_3 = Number(flatten(num_average_daylight_hours_2))
# Put in attribute names. If no additional attributes to join, keep id.
# 
# The list of numbers below is just dummy data for this example. Replace with actual data.
panel_3 = Panel("""4
10
5
12""")
int_hours_per_surface_2 = Integer(int_hours_per_surface)  # disabled

# ----
# 4. Set Attributes
attribute_names = Panel("""id
BBL
Avg_Daylight_Hours
Percent_Above_Daylight_Threshold""")
data_attributes_value_1 = Data(int_bbl_of_parks_4)
data_keys = Data(attribute_names)

# ---- group: Get Transformation
# Lat / Long just need to be a point within the city you are working on
# 1. Specify Georeference Location
panel_4 = Panel("-73.98187458515167")
# first draw the site boundary and download as geojson via geojson.io , then importing it into rhino as a reference, the script will project the reference boundary into a projection that is orthogonal
# 
# The user then moves and scale the rhino geo to where the reference is, then goes through the rest of the script to reproject back to wgs84 and export as geojson.
panel_5 = Panel("40.754674479887605")
getutm = _1GetUTM(Longitude=panel_4, Latitude=panel_5)
# Create GeoJSON
epsg4326 = _1EPSG4326()
trans = _2Transformation(SourceWKT=epsg4326, TargetWKT=getutm)

# ----
# 2. Add Reference Bounding Box
file_name_3 = Panel("Columbia_ref.geojson")
nickname_3 = RelativePath()
concat_5 = Concatenate(FragmentA=nickname_3, FragmentB="/")
concat_6 = Concatenate(FragmentA=concat_5, FragmentB=file_name_3)
readjson = ReadGeoJSON(File=concat_6)  # -> Type, Geometry, Keys, Values
crv_referencegeo = Curve(readjson.Geometry)

data_attributes_value_1_2 = Data(num_above_minimum_daylight_hours_3)
data_attributes_value_1_3 = Data(num_average_daylight_hours_3)

# ---- group: Reproject Geometry
disc = Discontinuity(Curve=crv_referencegeo, Level=1)  # -> Points, Parameters
closed_polygon = BooleanToggle(True)
reproj = _4Reprojection(SourcePoints=disc.Points, Transformation=trans)
pline = PolyLine(Vertices=reproj, Closed=closed_polygon)
crv_projected = Curve(pline)

# ---- group: Transform back to WGS84
epsg4326_2 = _1EPSG4326()
trans_2 = _2Transformation(SourceWKT=getutm, TargetWKT=epsg4326_2)

# ---- group: Move to Rhino Origin
disc_2 = Discontinuity(Curve=crv_projected, Level=1)  # -> Points, Parameters
avr = Average(Input=flatten(disc_2.Points))
vec2pt = Vector2Pt(PointA=avr, PointB="0,0,0", Unitize=False)  # -> Vector, Length
move_2 = Move(Geometry=crv_projected, Motion=vec2pt.Vector)  # -> Geometry, Transform
crv_moved_geo = Curve(move_2.Geometry)

# ----
data_attributes_value_1_4 = Data(graft(data_attributes_value_1_2))
data_attributes_value_1_5 = Data(graft(data_attributes_value_1_3))
points = FeatureFromPoints()
complexpolygon2feature = FeatureFromPolygons()
export = Button()

# ---- group: Geo Locate
srf_analysis_surfaces_2 = Surface(srf_open_space_2)
pt_start_point = Point(<point referenced from the Rhino model>)
pt_end_point = Point(<point referenced from the Rhino model>)
# Geo Locate
ln = Line(StartPoint=pt_start_point, EndPoint=pt_end_point)
move_3 = Move(Geometry=srf_analysis_surfaces_2, Motion=ln)  # -> Geometry, Transform
pt_end_point_2 = Point(pt_end_point)
scale = Scale(Geometry=move_3.Geometry, Center=pt_end_point_2, Factor=Slider(0.304, range=0..1))  # -> Geometry, Transform

# ----
clean_4 = CleanTree(RemoveNulls=True, RemoveInvalid=True, RemoveEmpty=True, Tree=scale.Geometry)

# ---- group: Geo Locate (continued)
srf_analysis_surfaces_3 = Surface(flatten(clean_4))

# ---- group: Export Geometry
# 3. Reference Export Geometry
# You'll need to move and scale the geometry you want to export to align with the GeoJSON bounding box.
crv = Curve(simplify(graft(srf_analysis_surfaces_3)))

# ---- group: Move Geometry back to UTM
transform = Transform(move_2.Transform)
transformation = Panel(transform)
inverse = InverseTransform(Transform=transform)
transform_2 = Transform(Geometry=crv, Transform=inverse)

# ---- group: Reproject Geometry
disc_3 = Discontinuity(Curve=transform_2, Level=1)  # -> Points, Parameters
closed_polygon_2 = BooleanToggle(True)
reproj_2 = _4Reprojection(SourcePoints=disc_3.Points, Transformation=trans_2)
pline_2 = PolyLine(Vertices=reproj_2, Closed=closed_polygon_2)
crv_projected_2 = Curve(pline_2)

# ----
index = ItemIndex(List=flatten(crv_projected_2), Item=flatten(crv_projected_2))  # -> graft(Index)
value = Panel(index)

data_attributes_value_1_6 = Data(graft(data_attributes_value_1))
data_keys_2 = Data(data_keys)
merge_4 = Merge(
    Data1=simplify(index),
    Data2=simplify(data_attributes_value_1_6),
    Data3=simplify(data_attributes_value_1_5),
    Data4=simplify(data_attributes_value_1_4))

# ----
# Features
crv_projected_3 = Curve(simplify(graft(crv_projected_2)))

# ----
# Attributes
data_keys_3 = Data(simplify(data_keys_2))
data_value = Data(merge_4)

lines = FeatureFromLines(Curves=crv_projected_3, Keys=data_keys_3, Values=data_value)  # disabled

# ---- group: Geometry to Feature
polygons = FeatureFromPolygons(Polygons=crv_projected_3, Keys=data_keys_3, Values=data_value)

# ---- group: Post-Process GeoJSON
join_2 = JoinGeoJSON(Features=flatten(polygons))
crs = Panel("ESPG:4326")
python = GhPythonScript(str=join_2, crs=crs)  # -> a
# ---------- python: Python ----------
__author__ = "rchou"
__version__ = "2022.03.16"

import rhinoscriptsyntax as rs


header = str[:28]
features = str[28:]

if _crs:
    crs = '"crs": { "type": "name", "properties": { "name": "urn:ogc:def:crs:' + _crs + '" } },' 
else:
    crs = '"crs": { "type": "name", "properties": { "name": "urn:ogc:def:crs:EPSG:4326" } },'

a = header + crs + features
# ---------- end python ----------

# ---- group: Write GeoJSON
# 5. Export GeoJSON
# Click the Export button to export!
overwrite_data = BooleanToggle(True)
file_name_4 = Panel("Columbia_daylight_analysis.geojson")
nickname_4 = RelativePath()
write_file = WriteFile(Directory=nickname_4, Filename=file_name_4, Data=python, Run=export, Overwrite=overwrite_data)

# ==== cluster Cluster
path_epw_file = ClusterInput()
int_start_hour = ClusterInput()
int_end_hour = ClusterInput()
int_time_step = ClusterInput()
int_months = ClusterInput()
int_day = ClusterInput()
path_epw_file_2 = FilePath(path_epw_file)
int_start_hour_2 = Integer(int_start_hour)
int_end_hour_2 = Integer(int_end_hour)
int_time_step_2 = Integer(int_time_step)
int_months_2 = Integer(int_months)
int_day_2 = Integer(int_day)
analysisperiod = LBAnalysisPeriod(
    start_month=int_months_2,
    start_day=int_day_2,
    start_hour=int_start_hour_2,
    end_month=int_months_2,
    end_day=int_day_2,
    end_hour=int_end_hour_2,
    timestep=int_time_step_2)  # -> period, hoys, dates; plug-in component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
subtraction = Subtraction(A=int_end_hour_2, B=int_start_hour_2)
importloc = LBImportLocation(epw_file=path_epw_file_2)  # -> location; plug-in component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
minimum_average_daylight_hours = ClusterInput()
int_number_of_hours_tested = Integer(subtraction)
srf_analysis_surfaces = ClusterInput()
pt_analysis_points = ClusterInput()
mesh_obstructions = ClusterInput()

pt_analysis_points_2 = Point(simplify(graft(pt_analysis_points)))
srf_analysis_surfaces_2 = Surface(graft(srf_analysis_surfaces))

sunpath = LBSunPath(location=importloc, hoys=analysisperiod.hoys, scale=1)  # -> report, vectors, altitudes, azimuths, hoys, sun_pts, analemma, daily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; plug-in component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
mesh_obstructions_2 = Mesh(mesh_obstructions)
minimum_average_daylight_hours_2 = Integer(minimum_average_daylight_hours)
occ = Occlusion(Samples=pt_analysis_points_2, Obstructions=mesh_obstructions_2, Rays=flatten(sunpath.vectors))  # -> Hits, simplify(Occlusion)
not = GateNot(A=occ.Occlusion)
path_mapper = PathMapper(not, source=["{A;B}", "{A}"], target=["{B}", "{A}"])
ma = MassAddition(Input=not)  # -> Result, PartialResults
lng = ListLength(List=not)
int_number_of_hours_tested_2 = Integer(int_number_of_hours_tested)
division = Division(A=ma.Result, B=lng)
multiplication = Multiplication(A=division, B=int_number_of_hours_tested_2)

path_mapper_2 = PathMapper(multiplication, source="{A;B}", target="{A}")
path_mapper_3 = PathMapper(division, source="{A;B}", target="{A}")
larger = LargerThan(FirstNumber=path_mapper_2, SecondNumber=minimum_average_daylight_hours_2)  # -> LargerThan, OrEqualTo
avr = Average(Input=path_mapper_2)
avr_2 = Average(Input=path_mapper_3)

panel = Panel("8")
gradient = Gradient(
    LowerLimit=minimum_average_daylight_hours_2,
    UpperLimit=int_number_of_hours_tested_2,
    Parameter=multiplication,
    stops=[0: RGB(64, 64, 64), 0.5: RGB(255, 255, 0), 1: RGB(255, 0, 0)])

viewer = ParamViewer(gradient)
viewer_2 = ParamViewer(srf_analysis_surfaces_2)

ma_2 = MassAddition(Input=larger.OrEqualTo)  # -> Result, PartialResults
lng_2 = ListLength(List=larger.OrEqualTo)
division_2 = Division(A=ma_2.Result, B=lng_2)
preview = CustomPreview(Geometry=srf_analysis_surfaces_2, Material=gradient)

num_above_minimum_daylight_hours = Number(division_2)
num_average_of_day_with_daylight = Number(avr_2)
num_hours_per_surface = Number(multiplication)
int_hours_per_surface = Integer(multiplication)
num_average_daylight_hours = Number(avr)
col_view_analysis_color = Colour(gradient)
srf_analysis_surfaces_3 = Surface(srf_analysis_surfaces_2)

srf_analysis_surfaces_4 = ClusterOutput(srf_analysis_surfaces_3)
col_view_analysis_color_2 = ClusterOutput(col_view_analysis_color)
num_average_daylight_hours_2 = ClusterOutput(num_average_daylight_hours)
num_average_of_day_with_daylight_2 = ClusterOutput(num_average_of_day_with_daylight)
num_above_minimum_daylight_hours_2 = ClusterOutput(num_above_minimum_daylight_hours)
int_hours_per_surface_2 = ClusterOutput(int_hours_per_surface)
num_hours_per_surface_2 = ClusterOutput(num_hours_per_surface)

# ==== cluster Cluster_2
srf_for_subdivision = ClusterInput()
int_subdivision_size = ClusterInput()
srf_for_subdivision_2 = Surface(simplify(graft(srf_for_subdivision)))
int_subdivision_size_2 = Integer(int_subdivision_size)
dim = Dimensions(Surface=srf_for_subdivision_2)  # -> UDimension, VDimension
division = Division(A=dim.UDimension, B=int_subdivision_size_2)
division_2 = Division(A=dim.VDimension, B=int_subdivision_size_2)
max = Maximum(A=division_2, B="1")
max_2 = Maximum(A=division, B="1")

panel = Panel(division)
panel_2 = Panel(max_2)

divide = DivideDomain²(Domain=srf_for_subdivision_2, UCount=max_2, VCount=max)
subsrf = Isotrim(Surface=srf_for_subdivision_2, Domain=divide)
srf_analysis_surfaces = Surface(subsrf)

evalsrf = EvaluateSurface(Surface=reparameterize(srf_analysis_surfaces), Point="{0.5,0.5,0}")  # -> Point, Normal, UDirection, VDirection, Frame
vdis = VectorDisplay(Anchor=evalsrf.Point, Vector=evalsrf.Normal)
incurve = PointInCurve(Point=evalsrf.Point, Curve=srf_for_subdivision_2)  # -> Relationship, Point

cull = CullPattern(List=srf_analysis_surfaces, CullPattern=incurve.Relationship)
cull_2 = CullPattern(List=evalsrf.Point, CullPattern=incurve.Relationship)

# ----
# This flip is specific to the PLUTO geometery for the tutorial! Remove if normals are already facing up! Check vectors to the right.
flip = Flip(Surface=cull)  # -> Surface, Result

srf_analysis_surfaces_2 = Surface(flip.Surface)
pt_analysis_points = Point(cull_2)
srf_analysis_surfaces_3 = ClusterOutput(srf_analysis_surfaces_2)
pt_analysis_points_2 = ClusterOutput(pt_analysis_points)
