# Grasshopper definition GeoJSON.gh (Grasshopper 1.0.8)
# plug-ins: Geospatial, glTFexporter

# ---- group: Get Transformation
# 1. Specify Georeference Location
panel = Panel("PROJCS[\"REGVEN_UTM_Zone_18N\",GEOGCS[\"GCS_REGVEN\",DATUM[\"D_REGVEN\",SPHEROID[\"GRS_1980\",6378137.0,298.257222101]],PRIMEM[\"Greenwich\",0.0],UNIT[\"Degree\",0.0174532925199433]],PROJECTION[\"Transverse_Mercator\"],PARAMETER[\"False_Easting\",500000.0],PARAMETER[\"False_Northing\",0.0],PARAMETER[\"Central_Meridian\",-75.0],PARAMETER[\"Scale_Factor\",0.9996],PARAMETER[\"Latitude_Of_Origin\",0.0],UNIT[\"Meter\",1.0]]")
# Lat / Long just need to be a point within the city you are working on
panel_2 = Panel("-73.98187458515167")
panel_3 = Panel("40.754674479887605")
epsg4326 = _1EPSG4326()
trans = _2Transformation(SourceWKT=epsg4326, TargetWKT=panel)

# ----
# first draw the site boundary and download as geojson via geojson.io , then importing it into rhino as a reference, the script will project the reference boundary into a projection that is orthogonal
# 
# The user then moves and scale the rhino geo to where the reference is, then goes through the rest of the script to reproject back to wgs84 and export as geojson.
# 2. Add Reference Bounding Box
file_name = Panel("map.geojson")
nickname = RelativePath()
concat = Concatenate(FragmentA=nickname, FragmentB="/")
concat_2 = Concatenate(FragmentA=concat, FragmentB=file_name)
readjson = ReadGeoJSON(File=concat_2)  # -> Type, Geometry, Keys, Values
crv_referencegeo = Curve(readjson.Geometry)

# ---- group: Export Geometry
# 3. Reference Export Geometry
# You'll need to move and scale the geometry you want to export to align with the GeoJSON bounding box.
crv = Curve([<curve referenced from the Rhino model> x4])

# ---- group: Get Transformation / This is an easier way to get UTM projection but there is currently a bug
getutm = _1GetUTM(Longitude=panel_2, Latitude=panel_3)

# ---- group: Reproject Geometry
disc = Discontinuity(Curve=crv_referencegeo, Level=1)  # -> Points, Parameters
closed_polygon = BooleanToggle(True)
reproj = _4Reprojection(SourcePoints=disc.Points, Transformation=trans)
pline = PolyLine(Vertices=reproj, Closed=closed_polygon)
crv_projected = Curve(pline)

# ---- group: Move to Rhino Origin
disc_2 = Discontinuity(Curve=crv_projected, Level=1)  # -> Points, Parameters
avr = Average(Input=flatten(disc_2.Points))
vec2pt = Vector2Pt(PointA=avr, PointB="0,0,0", Unitize=False)  # -> Vector, Length
move = Move(Geometry=crv_projected, Motion=vec2pt.Vector)  # -> Geometry, Transform
crv_moved_geo = Curve(move.Geometry)

# ---- group: Move Geometry back to UTM
rev = Reverse(Vector=vec2pt.Vector)
move_2 = Move(Geometry=crv, Motion=rev)  # -> Geometry, Transform

# ---- group: Transform back to WGS84
epsg4326_2 = _1EPSG4326()
trans_2 = _2Transformation(SourceWKT=panel, TargetWKT=epsg4326_2)

# ---- group: Reproject Geometry
disc_3 = Discontinuity(Curve=move_2.Geometry, Level=1)  # -> Points, Parameters
closed_polygon_2 = BooleanToggle(True)
reproj_2 = _4Reprojection(SourcePoints=disc_3.Points, Transformation=trans_2)
pline_2 = PolyLine(Vertices=reproj_2, Closed=closed_polygon_2)  # -> simplify(Polyline)
crv_projected_2 = Curve(pline_2)

# ----
# 4. Set Attributes
# Put in attribute names. If no additional attributes to join, keep id.
# 
# The list of random values is just dummy data for this example. Replace with actual data.
attribute_names = Panel("""id
Data_01""")
viewer = ParamViewer(crv_projected_2)
lng = ListLength(List=viewer)
random = Random(Range="0 to 20", Number=lng, Seed=2)
panel_4 = Panel(random)
data_keys = Data(attribute_names)
data_attributes_value_1 = Data(panel_4)

index = ItemIndex(List=flatten(crv_projected_2), Item=flatten(crv_projected_2))  # -> graft(Index)
value = Panel(index)

data_attributes_value_1_2 = Data(graft(data_attributes_value_1))
data_keys_2 = Data(data_keys)
merge = Merge(Data1=simplify(index), Data2=simplify(data_attributes_value_1_2))

# ----
# Features
crv_projected_3 = Curve(simplify(graft(crv_projected_2)))

# ----
# Attributes
data_keys_3 = Data(simplify(data_keys_2))
data_value = Data(merge)

# ---- group: Geometry to Feature
polygons = FeatureFromPolygons(Polygons=crv_projected_3, Keys=data_keys_3, Values=data_value)

# ----
lines = FeatureFromLines(Curves=crv_projected_3, Keys=data_keys_3, Values=data_value)
points = FeatureFromPoints()
complexpolygon2feature = FeatureFromPolygons()

# ---- group: Post-Process GeoJSON
join = JoinGeoJSON(Features=flatten(polygons))
crs = Panel("ESPG:4326")
python = GhPythonScript(str=join, crs=crs)  # -> a
# ---------- python: Python ----------
__author__ = "rchou"
__version__ = "2022.03.16"

import rhinoscriptsyntax as rs


header = str[:28]
features = str[28:]

if _crs:
    crs = '"crs": { "type": "name", "properties": { "name": "urn:ogc:def:crs:' + _crs + '" } },' 
else:
    crs = '"crs": { "type": "name", "properties": { "name": "urn:ogc:def:crs:EPSG:4326" } },'

a = header + crs + features
# ---------- end python ----------

# ----
export = Button()

# ---- group: Write GeoJSON
# 5. Export GeoJSON
# Click the Export button to export!
overwrite_data = BooleanToggle(True)
file_name_2 = Panel("Columbia_export.geojson")
nickname_2 = RelativePath()
write_file = WriteFile(Directory=nickname_2, Filename=file_name_2, Data=python, Run=export, Overwrite=overwrite_data)
