# Grasshopper definition GeoJSON_Analysis.gh (Grasshopper 1.0.8)
# plug-ins: Geospatial, Triceratops

day = Panel("15")
minimum_average_daylight_hours = Panel("2")
months = Panel("4")
start_hour = Panel("8")
subdivision_size = Panel("15")
end_hour = Panel("18")
time_step = Panel("1")
srf_open_space = Surface(<surface referenced from the Rhino model>)
geo_context = Geometry([<brep referenced from the Rhino model> x43])
path_epw_file = FilePath("C:\Users\Varun SA\Documents\computational-modelling\reference\Deriving Spatial Data_Files\USA_NY_New.York-Central.Park.725033_TMY3.epw")
brep_design = Brep([<brep referenced from the Rhino model> x2])  # disabled
mesh_context = Mesh(flatten(geo_context))
mesh_design = Mesh(flatten(brep_design))  # disabled
cluster = Cluster(srf_for_subdivision=srf_open_space, int_subdivision_size=subdivision_size)
mesh_join = MeshJoin(Meshes=mesh_context)
merge = Merge(Data1=mesh_join, Data2=mesh_design)
evaluate_surface = EvaluateSurface(Surface=reparameterize(cluster), Point="{0.5,0.5,0}")  # -> Point, Normal, UDirection, VDirection, Frame
mesh_join_2 = MeshJoin(Meshes=flatten(merge))

# ----
# Daylight to Streets
cluster_2 = Cluster_2(
    mesh_obstructions=mesh_join_2,
    srf_analysis_surfaces=cluster,
    pt_analysis_points=evaluate_surface.Point,
    path_epw_file=path_epw_file,
    int_months=months,
    int_day=day,
    int_start_hour=start_hour,
    int_end_hour=end_hour,
    int_time_step=time_step,
    minimum_average_daylight_hours=minimum_average_daylight_hours)  # -> srf_analysis_surfaces_4, col_view_analysis_color_2, num_average_daylight_hours_2, num_average_of_day_with_daylight_2, num_above_minimum_daylight_hours_2, int_hours_per_surface_2

# ---- group: Data Outputs
average_daylight_hours = Panel(cluster_2.num_average_daylight_hours_2)
average_of_day_with_daylight = Panel(cluster_2.num_average_of_day_with_daylight_2)
above_minimum_daylight_hours = Panel(cluster_2.num_above_minimum_daylight_hours_2)

# ----
num_above_minimum_daylight_hours = Number(cluster_2.num_above_minimum_daylight_hours_2)
num_average_daylight_hours = Number(cluster_2.num_average_daylight_hours_2)

# ---- group: Visualiztion
custom_preview = CustomPreview(Geometry=cluster_2.srf_analysis_surfaces_4, Material=cluster_2.col_view_analysis_color_2)

# ---- group: Get Transformation
# 1. Specify Georeference Location
panel = Panel("PROJCS[\"REGVEN_UTM_Zone_18N\",GEOGCS[\"GCS_REGVEN\",DATUM[\"D_REGVEN\",SPHEROID[\"GRS_1980\",6378137.0,298.257222101]],PRIMEM[\"Greenwich\",0.0],UNIT[\"Degree\",0.0174532925199433]],PROJECTION[\"Transverse_Mercator\"],PARAMETER[\"False_Easting\",500000.0],PARAMETER[\"False_Northing\",0.0],PARAMETER[\"Central_Meridian\",-75.0],PARAMETER[\"Scale_Factor\",0.9996],PARAMETER[\"Latitude_Of_Origin\",0.0],UNIT[\"Meter\",1.0]]")
# Lat / Long just need to be a point within the city you are working on
panel_2 = Panel("-73.98187458515167")
panel_3 = Panel("40.754674479887605")
_1_epsg_4326 = _1EPSG4326()
_2_transformation = _2Transformation(SourceWKT=_1_epsg_4326, TargetWKT=panel)

# ----
# first draw the site boundary and download as geojson via geojson.io , then importing it into rhino as a reference, the script will project the reference boundary into a projection that is orthogonal
# 
# The user then moves and scale the rhino geo to where the reference is, then goes through the rest of the script to reproject back to wgs84 and export as geojson.
# 2. Add Reference Bounding Box
file_name = Panel("map.geojson")
relativepath = RelativePath()
concatenate = Concatenate(FragmentA=relativepath, FragmentB="/")
concatenate_2 = Concatenate(FragmentA=concatenate, FragmentB=file_name)
read_geojson = ReadGeoJSON(File=concatenate_2)  # -> Type, Geometry, Keys, Values
crv_referencegeo = Curve(read_geojson.Geometry)

# ---- group: Export Geometry
# 3. Reference Export Geometry
# You'll need to move and scale the geometry you want to export to align with the GeoJSON bounding box.
curve = Curve([<curve referenced from the Rhino model> x4])

# ---- group: Get Transformation / This is an easier way to get UTM projection but there is currently a bug
_1_get_utm = _1GetUTM(Longitude=panel_2, Latitude=panel_3)

# ---- group: Reproject Geometry
discontinuity = Discontinuity(Curve=crv_referencegeo, Level=1)  # -> Points, Parameters
closed_polygon = BooleanToggle(True)
_4_reprojection = _4Reprojection(SourcePoints=discontinuity.Points, Transformation=_2_transformation)
polyline = PolyLine(Vertices=_4_reprojection, Closed=closed_polygon)
crv_projected = Curve(polyline)

# ---- group: Move to Rhino Origin
discontinuity_2 = Discontinuity(Curve=crv_projected, Level=1)  # -> Points, Parameters; disabled
average = Average(Input=flatten(discontinuity_2.Points))  # disabled
panel_4 = Panel("0,0,0")  # disabled
vector_2pt = Vector2Pt(PointA=average, PointB=panel_4, Unitize=False)  # -> Vector, Length; disabled
move = Move(Geometry=crv_projected, Motion=vector_2pt.Vector)  # -> Geometry, Transform; disabled
crv_moved_geo = Curve(move.Geometry)  # disabled

# ---- group: Move Geometry back to UTM
reverse = Reverse(Vector=vector_2pt.Vector)  # disabled
move_2 = Move(Geometry=curve, Motion=reverse)  # -> Geometry, Transform; disabled

# ---- group: Transform back to WGS84
_1_epsg_4326_2 = _1EPSG4326()
_2_transformation_2 = _2Transformation(SourceWKT=panel, TargetWKT=_1_epsg_4326_2)

# ---- group: Reproject Geometry
discontinuity_3 = Discontinuity(Curve=move_2.Geometry, Level=1)  # -> Points, Parameters
closed_polygon_2 = BooleanToggle(True)
_4_reprojection_2 = _4Reprojection(SourcePoints=discontinuity_3.Points, Transformation=_2_transformation_2)
polyline_2 = PolyLine(Vertices=_4_reprojection_2, Closed=closed_polygon_2)  # -> simplify(Polyline)
crv_projected_2 = Curve(polyline_2)

# ----
# 4. Set Attributes
# Put in attribute names. If no additional attributes to join, keep id.
# 
# The list of random values is just dummy data for this example. Replace with actual data.
attribute_names = Panel("""id
Data_01""")
param_viewer = ParamViewer(crv_projected_2)
list_length = ListLength(List=param_viewer)
random = Random(Range="0 to 20", Number=list_length, Seed=2)
panel_5 = Panel(random)
data_attributes_value_1 = Data(panel_5)
data_keys = Data(attribute_names)

item_index = ItemIndex(List=flatten(crv_projected_2), Item=flatten(crv_projected_2))  # -> graft(Index)
# Features
# Attributes
value = Panel(item_index)

data_attributes_value_1_2 = Data(graft(data_attributes_value_1))
data_keys_2 = Data(data_keys)
merge_2 = Merge(Data1=simplify(item_index), Data2=simplify(data_attributes_value_1_2))

# ----
# Features
crv_projected_3 = Curve(simplify(graft(crv_projected_2)))

# ----
# Attributes
data_keys_3 = Data(simplify(data_keys_2))
data_value = Data(merge_2)

# ---- group: Geometry to Feature
feature_from_polygons = FeatureFromPolygons(Polygons=crv_projected_3, Keys=data_keys_3, Values=data_value)

# ----
feature_from_polygons_2 = FeatureFromPolygons()
feature_from_lines = FeatureFromLines(Curves=crv_projected_3, Keys=data_keys_3, Values=data_value)
feature_from_points = FeatureFromPoints()

# ---- group: Post-Process GeoJSON
# Features
# Attributes
join_geojson = JoinGeoJSON(Features=flatten(feature_from_polygons))
crs = Panel("ESPG:4326")
# 5. Export GeoJSON
ghpython_script = GhPythonScript(str=join_geojson, crs=crs)  # -> a
# ---------- ghpython_script: Python ----------
__author__ = "rchou"
__version__ = "2022.03.16"

import rhinoscriptsyntax as rs


header = str[:28]
features = str[28:]

if _crs:
    crs = '"crs": { "type": "name", "properties": { "name": "urn:ogc:def:crs:' + _crs + '" } },' 
else:
    crs = '"crs": { "type": "name", "properties": { "name": "urn:ogc:def:crs:EPSG:4326" } },'

a = header + crs + features
# ---------- end ghpython_script ----------

# ----
export = Button()

# ---- group: Write GeoJSON
# Click the Export button to export!
overwrite_data = BooleanToggle(True)
file_name_2 = Panel("Columbia_export.geojson")
relativepath_2 = RelativePath()
write_file = WriteFile(Directory=relativepath_2, Filename=file_name_2, Data=ghpython_script, Run=export, Overwrite=overwrite_data)

# ==== cluster Cluster
srf_for_subdivision = ClusterInput()
int_subdivision_size = ClusterInput()
srf_for_subdivision_2 = Surface(graft(srf_for_subdivision))
int_subdivision_size_2 = Integer(int_subdivision_size)
dimensions = Dimensions(Surface=srf_for_subdivision_2)  # -> UDimension, VDimension
division = Division(A=dimensions.UDimension, B=int_subdivision_size_2)
division_2 = Division(A=dimensions.VDimension, B=int_subdivision_size_2)
divide_domain² = DivideDomain²(Domain=srf_for_subdivision_2, UCount=division, VCount=division_2)
isotrim = Isotrim(Surface=srf_for_subdivision_2, Domain=divide_domain²)
srf_analysis_surfaces = Surface(isotrim)
srf_analysis_surfaces_2 = ClusterOutput(srf_analysis_surfaces)

# ==== cluster Cluster_2
path_epw_file = ClusterInput()
int_start_hour = ClusterInput()
int_end_hour = ClusterInput()
int_time_step = ClusterInput()
int_months = ClusterInput()
int_day = ClusterInput()
path_epw_file_2 = FilePath(path_epw_file)
int_start_hour_2 = Integer(int_start_hour)
int_end_hour_2 = Integer(int_end_hour)
int_time_step_2 = Integer(int_time_step)
int_months_2 = Integer(int_months)
int_day_2 = Integer(int_day)
analysisperiod = LBAnalysisPeriod(
    start_month=int_months_2,
    start_day=int_day_2,
    start_hour=int_start_hour_2,
    end_month=int_months_2,
    end_day=int_day_2,
    end_hour=int_end_hour_2,
    timestep=int_time_step_2)  # -> period, hoys, dates; plug-in component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
subtraction = Subtraction(A=int_end_hour_2, B=int_start_hour_2)
importloc = LBImportLocation(epw_file=path_epw_file_2)  # -> location; plug-in component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
addition = Addition(A=subtraction, B="1")
int_number_of_hours_tested = Integer(addition)
srf_analysis_surfaces = ClusterInput()
pt_analysis_points = ClusterInput()
mesh_obstructions = ClusterInput()
pt_analysis_points_2 = Point(simplify(flatten(pt_analysis_points)))
sunpath = LBSunPath(location=importloc, hoys=analysisperiod.hoys, scale=1)  # -> report, vectors, altitudes, azimuths, hoys, sun_pts, analemma, daily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; plug-in component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
srf_analysis_surfaces_2 = Surface(flatten(srf_analysis_surfaces))
mesh_obstructions_2 = Mesh(mesh_obstructions)
minimum_average_daylight_hours = ClusterInput()
occlusion = Occlusion(Samples=pt_analysis_points_2, Obstructions=mesh_obstructions_2, Rays=sunpath.vectors)  # -> Hits, simplify(Occlusion)
minimum_average_daylight_hours_2 = Integer(minimum_average_daylight_hours)
gate_not = GateNot(A=occlusion.Occlusion)
path_mapper = PathMapper(gate_not, source=["{A;B}", "{A}"], target=["{B}", "{A}"])
list_length = ListLength(List=path_mapper)
mass_addition = MassAddition(Input=path_mapper)  # -> Result, PartialResults
int_number_of_hours_tested_2 = Integer(int_number_of_hours_tested)
division = Division(A=mass_addition.Result, B=list_length)
multiplication = Multiplication(A=division, B=int_number_of_hours_tested_2)
larger_than = LargerThan(FirstNumber=multiplication, SecondNumber=minimum_average_daylight_hours_2)  # -> LargerThan, flatten(OrEqualTo)
average = Average(Input=flatten(division))
average_2 = Average(Input=flatten(multiplication))
gradient = Gradient(
    LowerLimit=minimum_average_daylight_hours_2,
    UpperLimit="8",
    Parameter=multiplication,
    stops=[0: RGB(64, 64, 64), 0.5: RGB(255, 255, 0), 1: RGB(255, 0, 0)])
mass_addition_2 = MassAddition(Input=larger_than.OrEqualTo)  # -> Result, PartialResults
list_length_2 = ListLength(List=larger_than.OrEqualTo)
division_2 = Division(A=mass_addition_2.Result, B=list_length_2)

num_above_minimum_daylight_hours = Number(division_2)
num_average_of_day_with_daylight = Number(average)
int_hours_per_surface = Integer(multiplication)
num_average_daylight_hours = Number(average_2)
srf_analysis_surfaces_3 = Surface(graft(srf_analysis_surfaces_2))
col_view_analysis_color = Colour(gradient)

srf_analysis_surfaces_4 = ClusterOutput(srf_analysis_surfaces_3)
col_view_analysis_color_2 = ClusterOutput(col_view_analysis_color)
num_average_daylight_hours_2 = ClusterOutput(num_average_daylight_hours)
num_average_of_day_with_daylight_2 = ClusterOutput(num_average_of_day_with_daylight)
num_above_minimum_daylight_hours_2 = ClusterOutput(num_above_minimum_daylight_hours)
int_hours_per_surface_2 = ClusterOutput(int_hours_per_surface)
